# Grasshopper definition Kangaroo2実験.gh (Grasshopper 1.0.7)
# plug-ins: Kangaroo2 Components

# 基準円大きさ
number_slider = Slider(30, range=5..30)
# 分割点数(処理速度に多大な影響あり)
# （2,3000点の処理に耐えられるPCが理想）
number_slider_2 = Slider(400, range=100..400)
point = Point(Point(0, 0, 0))
# 広がり範囲(ただし値に比例しない様子)
number_slider_3 = Slider(0.3, range=0..0.3)
circle = Circle(Plane=point, Radius=number_slider)
panel = Panel(point)
# 要因値C: (値が小さいほど強い凝縮力が生じる)
# 円に近づく速度？： (1-A)×B÷C
number_slider_4 = Slider(10, range=0..10)
divide_curve = DivideCurve(Curve=circle, Count=number_slider_2, Kinks=False)  # -> Points, Tangents, Parameters
multiplication = Multiplication(A=number_slider, B=number_slider_3)
# 挙動変化 (基準値は0)
number_slider_5 = Slider(-1, range=-1..0.2)
polyline = PolyLine(Vertices=divide_curve.Points, Closed=invert(False))
# 要因値B: (0で完全停止, 値が大きいほど丸みを帯びやすい)
number_slider_6 = Slider(10, range=0..10)
spherecollide = SphereCollide(Points=divide_curve.Points, Radius=multiplication, Strength=number_slider_4)
# 要因値A: (値が大きいほど曲がりへの抵抗が強くなる)
number_slider_7 = Slider(1, range=0..1)
explode = Explode(Curve=polyline, Recursive=True)  # -> Segments, Vertices
plasticanchor = PlasticAnchor(Point=divide_curve.Points, Limit=number_slider_5, Strength=1, Reset=False)
number = Number(explode.Segments)
multiplication_2 = Multiplication(A=number_slider_7, B=number)
# 図形固定スイッチ
# (特に点の数を変更するときはFalseにすること)
boolean_toggle = BooleanToggle(True)
# リセットスイッチ
button = Button()
panel_2 = Panel(multiplication_2)
length_line = LengthLine(Line=explode.Segments, Length=multiplication_2, Strength=number_slider_6)
# 条件統合解析
solver = Solver(
    GoalObjects=[length_line, spherecollide, plasticanchor],
    Reset=button,
    Threshold=1e-15,
    Tolerance=0.0001,
    On=boolean_toggle)  # -> I, V, O
point_2 = Point(solver.V)
panel_3 = Panel(solver.I)
interpolate = Interpolate(Vertices=point_2, Degree=3, Periodic=invert(False), KnotStyle=1)  # -> Curve, Length, Domain
boundary_surfaces = BoundarySurfaces(Edges=interpolate.Curve)
custom_preview = CustomPreview(Geometry=boundary_surfaces, Material=ColourSwatch(SwatchColor=RGB(255, 255, 255)))
