# Grasshopper definition 詳細_Solver-01.gh (Grasshopper 1.0.7)
# plug-ins: Kangaroo2 Components

# ----
# １．元ジオメトリ準備
panel = Panel("30")
brep = Brep(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)
mplane = MeshPlane(Boundary={Plane=PlaneXY(-15, -10, 7), Size=Domain2(u=0..40, v=0..40)}, WidthCount=panel, HeightCount=panel)  # -> Mesh, Area

# ----
# ２．ゴールオブジェクト用
# データ準備（抽出／加工）
medges = MeshEdges(Mesh=mplane.Mesh)  # -> NakedEdges, InteriorEdges, NonManifoldEdges
Z = UnitZ(Factor=-0.1)
demesh = DeconstructMesh(Mesh=mplane.Mesh)  # -> Vertices, Faces, Colours, Normals
crv = Curve([medges.NakedEdges, medges.InteriorEdges])

# ----
# ３．ゴールオブジェクト
# （拘束条件・荷重条件など）
floor = Floor(Strength=1)
length_line = LengthLine(Line=crv, Strength=10)
spc = SolidPointCollide(Points=demesh.Vertices, Solid=brep, Interior=False, Unidirectional="True", Strength=1)
load = Load(Point=demesh.Vertices, ForceVector=Z)
show = Show(G=mplane.Mesh)

# ----
# ４．データ構造整理
# （出力用分類）
entwine = Entwine(Branch00=[floor, length_line, spc, load], Branch01=show, FlattenInputs=True)

# ----
# ５．ソルバー
button = Button()
solver = Solver(GoalObjects=entwine, Reset=button, Threshold=1e-15, Tolerance=0.01, On=Toggle(False))  # -> I, V, O

# ----
# ６．出力データの加工
item = ListItem(List=solver.O, Index=-1, Wrap=True)
demesh_2 = DeconstructMesh(Mesh=item)  # -> Vertices, Faces, Colours, Normals
srfgrid = SurfaceFromPoints(Points=demesh_2.Vertices, UCount=expr("x+1", panel), Interpolate=False)
