# Grasshopper definition 実験作 H型断面.gh (Grasshopper 1.0.7)

# ----
# H型鋼の高さ/2
# フランジの幅/2
# フランジ同士の間隔/2
# ウェブの厚み/2
number_slider = Slider(10, range=0..10)
number_slider_2 = Slider(7.6, range=0..10)
# H型鋼断面作成プログラム
number_slider_3 = Slider(10, range=0..10)
number_slider_4 = Slider(1.2, range=0..10)
construct_point = ConstructPoint(XCoordinate=number_slider_2, YCoordinate=number_slider_4, ZCoordinate="0")
construct_point_2 = ConstructPoint(XCoordinate="0", YCoordinate=number_slider_4, ZCoordinate="0")
construct_point_3 = ConstructPoint(XCoordinate=number_slider_3, YCoordinate=number_slider, ZCoordinate="0")
construct_point_4 = ConstructPoint(XCoordinate=number_slider_3, YCoordinate="0", ZCoordinate="0")
construct_point_5 = ConstructPoint(XCoordinate=number_slider_2, YCoordinate=number_slider, ZCoordinate="0")
polyline = PolyLine(Vertices=[construct_point_4, construct_point_3, construct_point_5, construct_point, construct_point_2], Closed=False)
yz_plane = YZPlane(Origin=Point(0, 0, 0))
mirror = Mirror(Geometry=polyline, Plane=yz_plane)  # -> Geometry, Transform
xz_plane = XZPlane(Origin=Point(0, 0, 0))
geometry = Geometry([polyline, mirror.Geometry])
mirror_2 = Mirror(Geometry=geometry, Plane=xz_plane)  # -> Geometry, Transform
geometry_2 = Geometry([mirror_2.Geometry, geometry])

mirror_curve = MirrorCurve(Tangent=True)
line = Line([Line((10.02739199, -1.378497275, 0), (10.9434555, 0.1040274254, 0)), Line((10.95005264, 0.1234642224, 0), (10.75922064, 0.3008007799, 0)), Line((10.74863624, 0.2850692663, 0), (10.42987214, -0.170098553, 0)), Line((10.45692273, -0.1485022668, 0), (9.798563105, 0.4259330213, 0)), Line((9.842746345, 0.4315551095, 0), (10.18705118, 0.8495056873, 0)), Line((10.18255763, 0.81111537, 0), (10.00428247, 1.036311036, 0))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])  # disabled
value_list = ValueList({"One": 1, "Two": 2, "Three": 2² - 1, "Four": Sqrt(16)}, selected="One")
point_list = PointList()

line_2 = Line(StartPoint=construct_point_3, EndPoint=construct_point)  # disabled
plane_3pt = Plane3Pt(PointA=construct_point_3, PointB=construct_point_5, PointC=construct_point)
polygon = Polygon(Plane=plane_3pt, Radius=3, Segments="3", FilletRadius=0)  # -> Polygon, Length
geometry_3 = Geometry(polygon.Polygon)
