# Grasshopper definition 実験作 リング.gh (Grasshopper 1.0.7)

radius = Slider(20, range=0..100)
width = Slider(8, range=0..10)
xz_plane = XZPlane(Origin=Point(0, 0, 0))
md_slider = MDSlider(
    SliderMode=0,
    slider_value=Point(0.5040651647, 1, 0.5),
    x_domain=Domain(0, 1),
    y_domain=Domain(0, 1),
    z_domain=Domain(0, 1))
md_slider_2 = MDSlider(
    SliderMode=0,
    slider_value=Point(1, 0.5008481654, 0.5),
    x_domain=Domain(0, 1),
    y_domain=Domain(0, 1),
    z_domain=Domain(0, 1))
md_slider_3 = MDSlider(
    SliderMode=0,
    slider_value=Point(0, 0.5008481654, 0.5),
    x_domain=Domain(0, 1),
    y_domain=Domain(0, 1),
    z_domain=Domain(0, 1))
md_slider_4 = MDSlider(
    SliderMode=0,
    slider_value=Point(0.4983896395, 0, 0.5),
    x_domain=Domain(0, 1),
    y_domain=Domain(0, 1),
    z_domain=Domain(0, 1))
circle = Circle(Plane=xz_plane, Radius=radius)
unit_y = UnitY(Factor=width)
u_count = Slider(4, range=1..12)
v_count = Slider(10, range=1..12)
extrude = Extrude(Base=circle, Direction=unit_y)
divide_domain² = DivideDomain²(Domain=extrude, UCount=u_count, VCount=v_count)
isotrim = Isotrim(Surface=extrude, Domain=divide_domain²)
evaluate_surface = EvaluateSurface(Surface=reparameterize(graft(isotrim)), Point=[md_slider, md_slider_2, md_slider_3, md_slider_4])  # -> Point, Normal, UDirection, VDirection, Frame
list_item = ListItem(List=evaluate_surface.Point, Index=0, Wrap=True)  # -> Item, Item1, Item2, Item3
cull_index = CullIndex(List=evaluate_surface.Point, Indices="2", Wrap=True)
cull_index_2 = CullIndex(List=evaluate_surface.Point, Indices="1", Wrap=True)
point = Point(list_item.Item2)
point_2 = Point(list_item.Item)
point_3 = Point(list_item.Item1)
point_4 = Point(list_item.Item3)
interpolate = Interpolate(Vertices=cull_index, Degree=3, Periodic=False, KnotStyle=1)  # -> Curve, Length, Domain
interpolate_2 = Interpolate(Vertices=cull_index_2, Degree=3, Periodic=False, KnotStyle=1)  # -> Curve, Length, Domain
pipe = Pipe(Curve=[interpolate.Curve, interpolate_2.Curve], Radius=Slider(0.33, range=0..1), Caps=0)
