# Grasshopper definition 数学：二次曲線.gh (Grasshopper 1.0.7)

multiplication = Multiplication(A="1", B="100")
division = Division(A=multiplication, B="-2")
panel = Panel(division)
series = Series(Start=division, Step="1", Count="100")
panel_2 = Panel(series)
evaluate = Evaluate(
    Expression="a*(x-b)^2+c",
    x=series,
    a=Slider(0.25, range=-1..1),
    b=Slider(0, range=-100..100),
    c=Slider(-5, range=-100..100))  # -> simplify(Result)
construct_point = ConstructPoint(XCoordinate=series, YCoordinate=evaluate, ZCoordinate=evaluate)
interpolate = Interpolate(Vertices=construct_point, Degree=3, Periodic=False, KnotStyle=1)  # -> Curve, Length, Domain
