# Grasshopper definition 数学：格子構造.gh (Grasshopper 1.0.7)

series = Series(Start=0, Step=1, Count="5")
cross_reference = CrossReference(ListA=series, ListB=series, ListC=series, CrossMode=1)  # -> ListA, ListB, ListC
construct_point = ConstructPoint(XCoordinate=cross_reference.ListA, YCoordinate=cross_reference.ListB, ZCoordinate=cross_reference.ListC)
sphere = Sphere(Base=construct_point, Radius="0.2")
