# Grasshopper definition 課題2 提出作品プログラム 3AA3-21.gh (Grasshopper 1.0.7)

# ----
# 描画位置の設定
# (極座標系設定 / Point Polarで代用可)
number_slider = Slider(0, range=-180..180)
# 相響角星
# 3AA3-21 袖山柾人
number_slider_2 = Slider(0, range=0..10)
cosine = Cosine(Value=degrees(number_slider))
sine = Sine(Value=degrees(number_slider))
multiplication = Multiplication(A=number_slider_2, B=cosine)
multiplication_2 = Multiplication(A=number_slider_2, B=sine)
construct_point = ConstructPoint(XCoordinate=multiplication, YCoordinate=multiplication_2, ZCoordinate=0)

# ----
# 衛星原点の配置設定
# ※惑星原点との距離"r"※
# ※最初の衛星位置※
# ※衛星数"p"※
xy_plane = XYPlane(Origin=construct_point)
# 推奨値： 5, 10, 10×cos(180°÷n)
number_slider_3 = Slider(10, range=0.01..20)
circle = Circle(Plane=xy_plane, Radius=number_slider_3)
rotate = Rotate(Geometry=circle, Angle=degrees(Slider(90, range=-180..180)), Plane=PlaneXY(0, 0, 0))  # -> Geometry, Transform
divide_curve = DivideCurve(Curve=rotate.Geometry, Count=Slider(50, range=1..50), Kinks=False)  # -> Points, Tangents, Parameters

# ----
# 惑星原点設定
# (動きに変化を生む要素。幾何学模様としての変化は起こらない。)
number_slider_4 = Slider(0, range=-10..10)
construct_point_2 = ConstructPoint(XCoordinate=number_slider_4, YCoordinate=Slider(0, range=-10..10), ZCoordinate=Slider(0, range=-10..10))

# ----
# ※惑星軌道要素※
# (このプログラムでは正円軌道のみ描くことができる。
# 　このブロックのプログラム次第で任意の曲線にもに対応可能)
number_slider_5 = Slider(0, range=-180..180)
rotate_2 = Rotate(Geometry=divide_curve.Points, Angle=degrees(number_slider_5), Plane=construct_point_2)  # -> Geometry, Transform

# ----
# 各衛星の配置 / 基準ベクトル情報
panel = Panel(divide_curve.Points)
panel_2 = Panel(divide_curve.Tangents)

# ----
# ※波状アニメーション化要素※
#  (a=0 以外のとき有効, a=±180でダイナミックな動きに)
number_slider_6 = Slider(60, range=-360..360)

# ----
# 移動軌跡の微調整要素
line = Line(StartPoint=divide_curve.Points, EndPoint=construct_point)
construct_plane = ConstructPlane(Origin=rotate_2.Geometry, XAxis=divide_curve.Tangents, YAxis=line)
rotate_3 = Rotate(Geometry=construct_plane, Angle=degrees(number_slider_6), Plane=PlaneXY(0, 0, 0))  # -> Geometry, Transform

# ----
# 各衛星の基準平面情報
panel_3 = Panel(construct_plane)

# ----
# 幾何学模様創出
# ※衛星形状設定"n"※
# (ここでの半径は10で固定)　(ブロックごと仕様変更すれば多角形以外にも対応可)
number_slider_7 = Slider(5, range=3..8)
polygon = Polygon(Plane=rotate_3.Geometry, Radius=10, Segments=number_slider_7, FilletRadius=0)  # -> Polygon, Length

# ----
# ※各衛星模様の回転角度設定"a"※
# 推奨値： 0, ±90, 180×(任意の整数)/n+90 など
number_slider_8 = Slider(60, range=-180..180)
rotate_4 = Rotate(Geometry=polygon.Polygon, Angle=degrees(number_slider_8), Plane=construct_plane)  # -> Geometry, Transform

# ----
# 完成模様の確認ボタン
geometry = Geometry(rotate_4.Geometry)
