# Grasshopper definition 12-1 GH教材（せんだいメディアテーク的な数量可視化）改.gh (Grasshopper 1.0.7)
# plug-ins: Bifocals, LunchBox

# ----
# 1. 基準点の配置
# Params＞Geometry＞Point
# 点の配置方法: アイコンを右クリック
# ↓
# 1つの点を配置する場合→Set one Point
# 複数の点を配置する場合→Set Multiple Points
# ↓
# Rhinocerosの画面へ
# ↓
# 任意の場所に点を配置
# ↓
# 「Enter」もしくは「右クリック」で配置を確定
# ↓
# 配置完了
ヒント_点の移動方法 = Panel("""コンポーネント「Point」のPrevewをオンにする
↓
コンポーネント「Point」を選択
↓
Rhinocerosの画面で移動可能に""")
point = Point(Point(-47.47155344, -71.85368603, 0))
# 第11週　せんだいメディアテーク的なモデルからの数量可視化
# 【Exceptions】
# コンポーネントの上部に
# コンポーネントの名称を
# 表示するコンポーネント
リスト内情報 = Panel(point)

# ----
# 【課題３】　操作用パラメータ
# 
# 各フロアの円の中心座標を決定
# 円の中心のX座標値
# 円の中心のY座標値
# Params＞Input＞Number Slider
# Sets＞Tree＞Merge
# Vector＞Vector＞Vector XYZ
_1fl_x = Slider(0, range=-5000..5000)
_2fl_x = Slider(377, range=-5000..5000)
_4fl_x = Slider(610, range=-5000..5000)
_3fl_x = Slider(-2280, range=-5000..5000)
_5fl_x = Slider(0, range=-5000..5000)
_1fl_y = Slider(748, range=-5000..5000)
_2fl_y = Slider(0, range=-5000..5000)
_3fl_y = Slider(0, range=-5000..5000)
_4fl_y = Slider(0, range=-5000..5000)
_5fl_y = Slider(174, range=-5000..5000)
vector_xyz = VectorXYZ(XComponent=_1fl_x, YComponent=_1fl_y, ZComponent=0)  # -> Vector, Length
vector_xyz_2 = VectorXYZ(XComponent=_2fl_x, YComponent=_2fl_y, ZComponent=0)  # -> Vector, Length
vector_xyz_3 = VectorXYZ(XComponent=_3fl_x, YComponent=_3fl_y, ZComponent=0)  # -> Vector, Length
vector_xyz_4 = VectorXYZ(XComponent=_4fl_x, YComponent=_4fl_y, ZComponent=0)  # -> Vector, Length
vector_xyz_5 = VectorXYZ(XComponent=_5fl_x, YComponent=_5fl_y, ZComponent=0)  # -> Vector, Length
merge = Merge(
    Data1=vector_xyz.Vector,
    Data2=vector_xyz_2.Vector,
    Data3=vector_xyz_3.Vector,
    Data4=vector_xyz_4.Vector,
    Data5=vector_xyz_5.Vector)
リスト内情報_2 = Panel(merge)

merge_2 = Merge(Data1="A", Data2="B", Data3="C", Data4="D", Data5="E")
panel = Panel(merge_2)

merge_3 = Merge(Data1="1", Data2="2", Data3="3", Data4="4", Data5="5")
panel_2 = Panel(merge_3)

# ----
# 【課題３】操作用パラメータ
# 
# 各フロアの円の半径を決定
# Params＞Input＞Number Slider
# Set＞Tree＞Merge
_1fl半径 = Slider(1601, range=0..5000)
_2fl半径 = Slider(1523, range=0..5000)
_3fl半径 = Slider(1805, range=0..5000)
_4fl半径 = Slider(2271, range=0..5000)
_5fl半径 = Slider(2009, range=0..5000)
merge_4 = Merge(Data1=_1fl半径, Data2=_2fl半径, Data3=_3fl半径, Data4=_4fl半径, Data5=_5fl半径)
# パラメータエリア
リスト内情報_3 = Panel(merge_4)

# ----
# データの掛け合わせについて
concatenate = Concatenate(FragmentA=panel, FragmentB=panel_2)
panel_3 = Panel(concatenate)

# ----
# 5.1.3 基準となる作業平面を入力
# Vector＞Plane＞XZ Plane
# Orientでオブジェクトを移動する
# ためのベースとなる作業平面を
# 入力する。
# 入力端子に何も入れなければ、
# 原点{0；0；0}で作業平面が生
# 成される。
xz_plane = XZPlane(Origin=Point(0, 0, 0))
リスト内情報_4 = Panel(xz_plane)

# ----
# 5.1 H形鋼の断面図を配置するための作業平面の作成
# 5.1.2 Rhinocerosにある
# 　 　 　H形鋼の断面図を入力
# Params＞Geometry＞Curve
# 決まった形状を使用する場合はRhinoceros
# でデータを作り、Grasshopperに読み込む方法
# を使うといい。
# Rhinocerosのデータを変更すると自動的に
# Grasshopperのデータも更新される。
curve = Curve(<curve referenced from the Rhino model>)
リスト内情報_5 = Panel(curve)

# ----
# データ複製に関する補足
# データの複製とリスト化
# ※Dataへの情報の与え方や
# 　Orderの設定によって結果が変わる
number_slider = Slider(3, range=0..10)
panel_4 = Panel("""100
200""")
duplicate_data = DuplicateData(Data=panel_4, Number=number_slider, Order=Toggle(True))
panel_5 = Panel(duplicate_data)

# ----
# 2. 各フロアのサーフェス（面）を作成
# 2.1 フロアの外形線の作成（全フロア共通）
# Curve＞Primitive＞Rectangle
# 2.3 各フロアの階高設定
# Maths＞Operators＞Mass Addition
# Set＞Tree＞Merge
# Params＞Input＞Number Slider
_1階_階高 = Slider(5000, range=0..10000)
_2階_階高 = Slider(5000, range=0..10000)
_3階_階高 = Slider(5000, range=0..10000)
_4階_階高 = Slider(5000, range=0..10000)

# ----
# フロアの外形線として
# 長方形を作成する
y方向の大きさ = Panel("10000")
x方向の大きさ = Panel("10000")

rectangle = Rectangle(Plane=point, XSize=x方向の大きさ, YSize=y方向の大きさ, Radius=0)  # -> Rectangle, Length

リスト内情報_6 = Panel(rectangle.Rectangle)

# ----
# 累加リスト作成
# （入力した数字のリストの
# 0行から各行までの合計値の
# リストを作成する）
# 複数の数字から
# 数字のリストを作成
基礎 = Panel("0")

merge_5 = Merge(Data1=基礎, Data2=_1階_階高, Data3=_2階_階高, Data4=_3階_階高, Data5=_4階_階高)
mass_addition = MassAddition(Input=merge_5)  # -> Result, PartialResults

リスト内情報_7 = Panel(merge_5)
リスト内情報_8 = Panel(mass_addition.PartialResults)

# ----
# 下川、廣瀬
# 2.2 フロア外形線のコピー＆移動
# Transform＞Euclidean＞Move
# Vector＞Vector＞Unit Z
# 各フロアの高度リストから
# 各フロア用の移動ベクトルを
# 作成する
# Moveでは、図形１つに対して複数の
# 移動ベクトルが入力された場合、
# 自動的に移動ベクトルの数だけ
# 図形がコピーされる
unit_z = UnitZ(Factor=mass_addition.PartialResults)
リスト内情報_9 = Panel(unit_z)
move = Move(Geometry=rectangle.Rectangle, Motion=unit_z)  # -> Geometry, Transform
リスト内情報_10 = Panel(move.Geometry)

# ----
# 2.3 各フロア外形線に
# 　 　サーフェス（面）を張る
# Surface＞Freeform＞Boundary Surfaces
# コピー＆移動された全てのフロア
# 外形線にサーフェス（面）を張る
boundary_surfaces = BoundarySurfaces(Edges=move.Geometry)
リスト内情報_11 = Panel(boundary_surfaces)

# ----
# 3. 各フロアの円形H型鋼の基準線を作成
# 3.1 各フロアの中心点の抽出
# Surface＞Analysis＞Area
# 3.2 各フロアの円の中心を決定
# 3.3 円形H型鋼の基準線を作成
# Transform＞Euclidean＞Move
# Curve＞Primitive＞Circle
area = Area(Geometry=boundary_surfaces, UseTasks=False)  # -> Area, Centroid
リスト内情報_12 = Panel(area.Centroid)
move_2 = Move(Geometry=area.Centroid, Motion=merge)  # -> Geometry, Transform
circle = Circle(Plane=move_2.Geometry, Radius=merge_4)
リスト内情報_13 = Panel(circle)

# ----
# 4.2 オフセットによるフロア開口線作成
# Params＞Input＞Number Slider
# Curve>Util>Offset Curve
# 1つ前の処理で作成した円は
# H型鋼の梁用の基準線である。
# フロアの開口はもっと外側で
# 開けたいので、梁基準線を
# 開口線としてオフセットする。
# 5. 円形H形鋼の作成
オフセット距離 = Slider(500, range=0..1000)
offset_curve = OffsetCurve(Curve=circle, Distance=オフセット距離, Plane=PlaneXY(0, 0, 0), Corners=1)
panel_6 = Panel(offset_curve)

# ----
# 4. 各フロアのサーフェスに開口を設け、厚みをつけてスラブ化する
# 4.1 リスト処理のためのデータ階層化（Graft）
# 複数のリストデータを組み合わせて何らかの処理を
# 行う場合、ケースに合わせてリストの階層を変更さ
# せる必要がある。
# ↓
# この後、各フロアのサーフェスに
# 円形の穴を開けたい。
# 各フロア用に穴を開けるための
# 円はフロアと同じ順番でリスト化
# されている。
# そのため、ここでは階層を増やし、
# 掛け合わせ先のリストを同じ階層
# に揃えておく必要がある。
# Params＞Geometry＞Surface
# 【重要】データ構造の変更: 入力端子or出力端子 を右クリック
# 　　　　　　　　　　↓
# Graft：データ構造の階層を1つ上げる
# 　　　　　（Sets＞Tree＞Graft Tree）でも同様
# 
# Flatten：データ構造の階層を1つにまとめる
# 　　　　　（Sets＞Tree＞Flatten Tree）でも同様
# 
# データ階層の詳細は株式会社アプリクラフトのHPへ
# https://www.applicraft.com/tips/rhinoceros/graft_flatten_simplify/
リスト内情報_14 = Panel(boundary_surfaces)
surface = Surface(graft(boundary_surfaces))
リスト内情報_15 = Panel(surface)

# ----
# 6. 支柱と水平リングの作成
# 6.1 支柱の基準点を配置する
# 支柱は円形H型鋼をつないでいるため、円形H形鋼の基準線を基に
# 基準点を作成する。
# 
# 支柱は等間隔に配置し、支柱の数は任意に変更できるようにしたい。
# 
# そのため、ここでは[Divide Curve]を使い、円形H形鋼の基準線を
# 等分割するように点を配置する
# Params＞Input＞Number Slider
# Curve＞Division＞Divide Curve
支柱数 = Slider(10, range=0..20)
divide_curve = DivideCurve(Curve=circle, Count=支柱数, Kinks=False, UseTasks=False)  # -> Points, Tangents, Parameters
リスト内情報_16 = Panel(divide_curve.Points)

# ----
# 6.2 支柱の傾きを指定する
# 柱を傾けるため、支柱の基準点リストを
# 指定の数だけ移動させる
# Set＞Tree＞Merge
# Sets > Sequence > Series
# Params＞Input＞Number Slider
# Maths＞Operators＞Negative
start = Slider(0, range=0..3)
移動支点数 = Slider(1, range=0..3)
# Shift Listの概要
# 0
# 4
# 3
count = Slider(5, range=0..5)
# ←リスト番号
# 1
# ------------→
# Shift List
# 　→[2]
# 2
series = Series(Start=start, Step=移動支点数, Count=count)  # -> graft(Series)
リスト内情報_17 = Panel(series)
# 3
# 2
# 4
# 0
# 1
negative = Negative(Value=series)
shift_list = ShiftList(List=divide_curve.Points, Shift=series, Wrap=True)
shift_list_2 = ShiftList(List=divide_curve.Points, Shift=negative, Wrap=True)
リスト内情報_18 = Panel(negative)
リスト内情報_19 = Panel(shift_list_2)
リスト内情報_20 = Panel(shift_list)

# ----
# 5.2.2 作業平面のX軸方向の点を選択
# 　　　　　→円の中心点を抽出
# Params＞Geometry＞Point
# Surface＞Analysis＞Area
area_2 = Area(Geometry=circle, UseTasks=False)  # -> Area, Centroid
point_2 = Point(area_2.Centroid)
リスト内情報_21 = Panel(point_2)

# ----
# 5.2 移動先の作業平面を作成
# 5.2.1 作業平面の原点を選択
# 　　　　　→円の始点を抽出
# 線データには始点と終点が存在する。
# そのため、線データには描いた方向も関係している。
# 始点
# 線の方向
# Curve＞Analysis＞End Points
end_points = EndPoints(Curve=circle)  # -> Start, End
# 円データも一本の線データとして扱うことができる。
# つまり、円データにも始点と終点が存在する。
# ※始点と終点は同じ位置に存在する。
# 終点
# 終点
# 始点
# 線の方向
リスト内情報_22 = Panel(end_points.Start)

# ----
# 5.2.3 作業平面のY軸方向の点を選択
# 　　　　　→円の始点をZ軸方向に移動
# Vector＞Vector＞Unit Z
# Transform＞Euclidean＞Move
# 移動する距離値は
# 何でもよい。
# ここでは定数「10」
# を入力しておく。
定数 = Panel("1000")
unit_z_2 = UnitZ(Factor=定数)
リスト内情報_23 = Panel(unit_z_2)
move_3 = Move(Geometry=end_points.Start, Motion=unit_z_2)  # -> Geometry, Transform
リスト内情報_24 = Panel(move_3.Geometry)

# ----
# 4.3 フロアのサーフェスの開口処理
# 入力端子の
# データ階層を揃える
# Intersect＞Physical＞Surface Split
# フロアのサーフェスを円で切り取る
# ことで、その外側と内側のサーフェス
# に分割する
# Sets＞List＞List Item
# 各階のペアのサーフェスのうち、
# 0番目（円の外側）のサーフェス
# のみ残したいので、0番目のみの
# データ（アイテム）を取り出す
# 1FLのスラブ
# フロアごとに円の外側のサーフェスと
# 円の内側のサーフェスがそれぞれ
# ペアになってリスト化されている
surface_split = SurfaceSplit(Surface=surface, Curves=offset_curve)
リスト内情報_25 = Panel(surface_split)
重要_panelの入力に関する注意 = Panel("""数値を変更することがない（定数）場合は「Panel」に直接書き込むとよい
↓
数値入力後にエンターを押して改行しないこと
↓
改行してしまうと空欄のデータができてしまい、エラーが発生する""")
リスト選択 = Panel("0")
list_item = ListItem(List=surface_split, Index=リスト選択, Wrap=True)
リスト内情報_26 = Panel(list_item)

# ----
# 5.1.4 移動先の作業平面
# Vector＞Plane＞Plane 3Pt
# 3つの点情報から
# 作業平面を作成する。
# ・Point A→原点を入力
# ・Point B→X軸を指す点を入力
# ・Point C→Y軸を指す点を入力
plane_3pt = Plane3Pt(PointA=end_points.Start, PointB=point_2, PointC=move_3.Geometry)
リスト内情報_27 = Panel(plane_3pt)

# ----
# 複数の点を直線で繋げる[PolyLine]コンポーネントは
# ブランチ内の点データで線を生成する。
# ←これで区切られる1つのデータ群のことをブランチという
# この点データをつなぐように線を作成する
リスト内情報_28 = Panel(リスト内情報_20)

# ----
# 6.3 支柱の中心線を作成
# Set＞Tree＞Flip Matrix
# ★ Curve＞Spline＞PolyLine
# Set＞Tree＞Flip Matrix
# Curve＞Spline＞PolyLine
flip_matrix = FlipMatrix(Data=shift_list)
flip_matrix_2 = FlipMatrix(Data=shift_list_2)
# このままだと。。。✖
polyline = PolyLine(Vertices=flip_matrix, Closed=False)
polyline_2 = PolyLine(Vertices=flip_matrix_2, Closed=False)
# このようにしたい。。。〇
リスト内情報_29 = Panel(polyline)
リスト内情報_30 = Panel(polyline_2)

# ----
# Flip Matrixについて
# 各フロアのリスト「0」のデータ
# 1FLにある点データ
リスト内情報_31 = Panel(リスト内情報_19)
リスト内情報_32 = Panel(flip_matrix_2)

# ----
# 4.4 フロアの厚みを付ける
# Vector＞Vector＞Unit Z
# Params＞Input＞Number Slider
# Surface＞Freeform＞Extrude
スラブ厚さ = Slider(500, range=0..1000)
unit_z_3 = UnitZ(Factor=スラブ厚さ)
リスト内情報_33 = Panel(unit_z_3)
extrude = Extrude(Base=list_item, Direction=unit_z_3)
リスト内情報_34 = Panel(extrude)

# ----
# 5.1.1 H形鋼の断面図を
# 　　 　 H形鋼の基準線としての円に配置する
# Transform＞Euclidean＞Orient
# オブジェクトを基準作業平面から
# 移動先作業平面へと回転・移動させる。
orient = Orient(Geometry=curve, Source=xz_plane, Target=plane_3pt)  # -> graft(Geometry), Transform
リスト内情報_35 = Panel(orient.Geometry)

# ----
# 5.3 H形鋼の断面図を配置するための作業平面の作成
# 5.3.2 H形鋼の基準線
# 　 　 　としての円を入力
# 5.3.1 H形鋼の断面形状を円に
# 　 　 　沿って押し出して立体化する。
# 【Graft】することに注意
# Params＞Geometry＞Curve
# Surface＞Freeform＞Sweep1
curve_2 = Curve(graft(circle))
リスト内情報_36 = Panel(curve_2)
sweep1 = Sweep1(Rail=curve_2, Sections=orient.Geometry, Miter=1)
リスト内情報_37 = Panel(sweep1)

# ----
# 6.5 水平リングの位置の設定
# 支柱を固定する水平リングを作成する。
# 水平リングは各フロアの高さで任意に設定できるようにする。
# ただし、支柱の中心線は全フロアを貫く1本の折れ線になっている。
# そのため、まず折れ線をフロア毎に分解[Explode]し、
# フロア毎に、各中心線内における特定の割合を決め、
# その位置の点データを求めている[Evaluate Length]。
# Params＞Input＞Number Slider
# Curve＞Util＞Explode
# ★ Curve＞Analysis＞Evaluate Length
# Params＞Input＞Boolean Toggle
explode = Explode(Curve=polyline, Recursive=True)  # -> Segments, Vertices
# 線データの正規化 True/False
# 正規化とは？
# 　線や面データを扱う上で、実際の長さでは操作しに
# 　くい場合がある。
# 　その時、実際の距離ではなく「0～1」の仮想距離と
# 　して置き換えることを正規化という。
# 500mm
# 0mm
# 1
# 0
# 線データの正規化
boolean_toggle = BooleanToggle(True)
リスト内情報_38 = Panel(explode.Segments)
# 750mm
# 0mm
# 1
# 1
# 0
# 面データの正規化
evaluate_length = EvaluateLength(Curve=explode.Segments, Length=Slider(0.5, range=0..1), Normalized=boolean_toggle)  # -> Point, Tangent, Parameter
リスト内情報_39 = Panel(evaluate_length.Tangent)

# ----
# 6.4 基準線をもとに支柱を作成
# Surface＞Freeform＞Pipe
# Params＞Input＞Number Slider
# ９へ接続
支柱の半径 = Slider(100, range=0..100)
# ８へ接続
number = Number(支柱の半径)
pipe = Pipe(Curve=[polyline, polyline_2], Radius=支柱の半径, Caps=0)
リスト内情報_40 = Panel(pipe)

# ----
# 6.6 水平リングの中心線を作成
# Set＞List＞Flip Matrix
# 各フロアで水平リングを作成するため、
# [Flip Matrix]を用いて、各ブランチ内で
# 縦に連なった点データを、
# 横に連なった点データへと変更する。
# Params＞Input＞Boolean Toggle
# Curve＞Spline＞Interpolate
flip_matrix_3 = FlipMatrix(Data=evaluate_length.Point)
リスト内情報_41 = Panel(flip_matrix_3)
interpolate = Interpolate(Vertices=flip_matrix_3, Degree=3, Periodic=Toggle(True), KnotStyle=1)  # -> Curve, Length, Domain
リスト内情報_42 = Panel(interpolate.Curve)

# ----
# 6.7 フレームの太さ
# Params＞Input＞Number Slider
# Surface＞Freeform＞Pipe
フレームの半径 = Slider(100, range=0..100)
pipe_2 = Pipe(Curve=interpolate.Curve, Radius=フレームの半径, Caps=0)
リスト内情報_43 = Panel(pipe_2)

# ----
# 支柱の基準線を分解し、寸法表示位置を決める
# 引き出し線の位置調整
# 基準線のブランチを縦系列から
# フロア系列に組み替える
entwine = Entwine(Branch00=polyline, Branch01=polyline_2, FlattenInputs=True)  # -> flatten(Result)
リスト内情報_44 = Panel(entwine)
explode_2 = Explode(Curve=entwine, Recursive=True)  # -> simplify(Segments), Vertices
# ７．支柱の部材長さ表示（練習）
# 支柱の基準線のデータに基づいて部材の長さを取得して表示する。
number_slider_2 = Slider(0, range=0..10)
リスト内情報_45 = Panel(explode_2.Segments)
list_item_2 = ListItem(List=explode_2.Segments, Index=number_slider_2, Wrap=True)
tree_branch = TreeBranch(Tree=explode_2.Segments, Path=Slider(0, range=0..20), MaintainPaths=True)
flip_matrix_4 = FlipMatrix(Data=explode_2.Segments)
cherry_picker = CherryPicker(flip_matrix_4, ListIndex=0, TreePath_path="{0}")
リスト内情報_46 = Panel(flip_matrix_4)
point_on_curve = PointOnCurve(flip_matrix_4, parameter=1)
リスト内情報_47 = Panel(point_on_curve)

# ----
# フロア高さ毎の支柱群の重心を求める
bounding_box = BoundingBox(Content=point_on_curve, Plane=PlaneXY(0, 0, 0), UnionBox=True)  # -> Box, Box_2
area_3 = Area(Geometry=bounding_box.Box)  # -> Area, Centroid
リスト内情報_48 = Panel(area_3.Centroid)

# ----
# 設計者が部材制作を行うメーカーに部材情報を
# 分かり易く渡すための情報連携作業を想定した
# 部材一覧表を作成する。
# 部材に番付を行い、モデル中と表中の両方に
# 表示することで情報の紐づけが容易にしている。
# フロア毎に組み替えた支柱の基準線
geometry = Geometry(flip_matrix_4)

# ----
# 基準線の長さリストを作成
# 小数点以下を四捨五入
# ８．支柱の部材一覧表の作成
length = Length(Curve=flip_matrix_4)
round = Round(Number=length)  # -> Nearest, Floor, Ceiling
リスト内情報_49 = Panel(round.Nearest)

# ----
# 寸法の引き出し線を作成
vector_2pt = Vector2Pt(PointA=area_3.Centroid, PointB=point_on_curve, Unitize=False)  # -> Vector, Length
vector_display = VectorDisplay(Anchor=area_3.Centroid, Vector=vector_2pt.Vector)
リスト内情報_50 = Panel(vector_2pt.Vector)
引き出し線長さ = Slider(2126, range=0..5000)
line_sdl = LineSDL(Start=point_on_curve, Direction=vector_2pt.Vector, Length=引き出し線長さ)
リスト内情報_51 = Panel(line_sdl)

# ----
# 支柱の形状データを分解し、
# ブランチを位置毎から
# フロア毎に組み替え
# 支柱の向きを区別
# するブランチを削除
deconstruct_brep = DeconstructBrep(Brep=pipe)  # -> simplify(Faces), Edges, Vertices
panel_7 = Panel(deconstruct_brep.Faces)
cherry_picker_2 = CherryPicker(deconstruct_brep.Faces, ListIndex=0, TreePath_path="{0;0}")
path_mapper = PathMapper(deconstruct_brep.Faces, source="{xy;dir}(fl)", target="{fl;dir}(xy)")
panel_8 = Panel(path_mapper)
cherry_picker_3 = CherryPicker(path_mapper, ListIndex=0, TreePath_path="{0;0}")
trim_tree = TrimTree(Tree=path_mapper, Depth=1)
リスト内情報_52 = Panel(trim_tree)
cherry_picker_4 = CherryPicker(trim_tree, ListIndex=0, TreePath_path="{0}")

# ----
# ブランチのデータ個数から一覧表の行列数を求める
tree_statistics = TreeStatistics(Tree=geometry)  # -> Paths, Length, Count
panel_9 = Panel(tree_statistics.Paths)
panel_10 = Panel(tree_statistics.Count)
list_item_3 = ListItem(List=tree_statistics.Length, Index="0", Wrap=True)
panel_11 = Panel(tree_statistics.Length)
表の行数_y = Number(tree_statistics.Count)
表の列数_x = Number(list_item_3)

# ----
# 表の枠線を作成
number_slider_3 = Slider(5142, range=0..10000)
point_3 = Point(Point(13289.97432, -19621.88377, 0))
rectangular = Rectangular(Plane=point_3, SizeX=number_slider_3, SizeY=Slider(10000, range=0..10000), ExtentX=表の列数_x, ExtentY=表の行数_y)  # -> Cells, Points
panel_12 = Panel(rectangular.Cells)
flip_matrix_5 = FlipMatrix(Data=rectangular.Cells)
panel_13 = Panel(flip_matrix_5)

# ----
# 部材長さを表示
寸法文字サイズ = Slider(209, range=0..1000)
marker_dimension = MarkerDimension(Line=line_sdl, Text=round.Nearest, Size=寸法文字サイズ)

# ----
# 支柱の番付
panel_14 = Panel("1")
series_2 = Series(Start=panel_14, Step=panel_14, Count=表の行数_y)
panel_15 = Panel(series_2)
concatenate_2 = Concatenate(FragmentA=series_2, FragmentB="FL")  # -> graft(Result)
series_3 = Series(Start="1", Step="1", Count=表の列数_x)
panel_16 = Panel(concatenate_2)
panel_17 = Panel(series_3)
concatenate_3 = Concatenate(FragmentA=concatenate_2, FragmentB=series_3)  # -> simplify(Result)
panel_18 = Panel(concatenate_3)

# ----
# 支柱を配置するための基準線を支柱の中心線の長さから作成
length_2 = Length(Curve=geometry)
area_4 = Area(Geometry=flip_matrix_5)  # -> Area, Centroid
panel_19 = Panel(length_2)
unit_y = UnitY(Factor=1)
division = Division(A=length_2, B=2)
negative_2 = Negative(Value=division)
line_sdl_2 = LineSDL(Start=area_4.Centroid, Direction=unit_y, Length=length_2)
panel_20 = Panel(division)
unit_y_2 = UnitY(Factor=negative_2)
move_4 = Move(Geometry=line_sdl_2, Motion=unit_y_2)  # -> Geometry, Transform

# ----
# 支柱オブジェクトを、
# モデル内基準線から表内基準線に
# 位置合わせする
orient_2 = Orient(Geometry=trim_tree, Source=geometry, Target=move_4.Geometry)  # -> Geometry, Transform

# ----
# 【課題４】　完成モデル確認
# 　　　　　　＆　操作パラメータ
# モデル内の部材情報：引き出し線位置
# 
# モデル内の部材情報：引き出し線長さ
# 
# モデル内の部材情報
# 
# 一覧表内：部材長寸法
# 
# 一覧表内：部材番号
# 
# 一覧表内：鋼管直径
# 
# Excel書き出し
data = Data([extrude, pipe_2, pipe, sweep1, orient_2.Geometry, rectangular.Cells])

# ----
# 表内での支柱の番付と直径の表示
# 一覧表内：部材番号
# 一覧表内：鋼管直径
panel_21 = Panel("0")
文字サイズ = Slider(300, range=0..1000)
evaluate_box = EvaluateBox(Box=flip_matrix_5, UParameter="0.5", VParameter=panel_21, WParameter=0.5)  # -> Plane, Point, Include
unit_y_3 = UnitY(Factor=文字サイズ)
move_5 = Move(Geometry=evaluate_box.Point, Motion=unit_y_3)  # -> Geometry, Transform
# １０．部材情報のExcelファイルへの書き出し
multiplication = Multiplication(A=number, B=2)
unit_y_4 = UnitY(Factor="800")
move_6 = Move(Geometry=move_5.Geometry, Motion=unit_y_4)  # -> Geometry, Transform
concatenate_4 = Concatenate(FragmentA="Φ=", FragmentB=multiplication)
text_tag_3d = TextTag3D(Location=move_5.Geometry, Text=concatenate_3, Size=文字サイズ, Justification=5)
text_tag_3d_2 = TextTag3D(Location=move_6.Geometry, Text=concatenate_4, Size=文字サイズ, Justification=5)

# ----
# Excelに書き出す部材データの準備
# データの複製とリスト化
# 支柱の数のカウント
# 支柱の番付リストを単純化
# 支柱の基準線リストを単純化
# 小数点以下を四捨五入
# データの複製とリスト化
flatten_tree = FlattenTree(Tree=geometry, Path="{0}")
panel_22 = Panel(flatten_tree)
flatten_tree_2 = FlattenTree(Tree=concatenate_3, Path="{0}")
length_3 = Length(Curve=flatten_tree)
panel_23 = Panel(flatten_tree_2)
panel_24 = Panel(length_3)
integer = Integer(length_3)
list_length = ListLength(List=flatten_tree_2)
panel_25 = Panel(integer)
multiplication_2 = Multiplication(A=number, B="2")
repeat_data = RepeatData(Data="鋼管", Length=list_length)
repeat_data_2 = RepeatData(Data=multiplication_2, Length=list_length)
panel_26 = Panel(repeat_data)
panel_27 = Panel(repeat_data_2)

# ----
# 支柱の中心線の長さから寸法線を作成
# 一覧表内：部材長寸法
number_slider_4 = Slider(500, range=0..1000)
文字サイズ_2 = Slider(300, range=0..1000)
end_points_2 = EndPoints(Curve=move_4.Geometry)  # -> Start, End
xy_plane = XYPlane(Origin=Point(0, 0, 0))
aligned_dimension = AlignedDimension(Plane=xy_plane, PointA=end_points_2.Start, PointB=end_points_2.End, Offset=number_slider_4, Text="{0:0}", Size=文字サイズ_2)

# ----
# ９．支柱の部材長さ表示
# 支柱の基準線のデータに基づいて部材の長さを取得して表示する。
# モデル内での支柱の番付表示
# モデル内の部材情報：引き出し線位置
# モデル内の部材情報：引き出し線長さ
# モデル内の部材情報
point_on_curve_2 = PointOnCurve(geometry, parameter=0.688)
bounding_box_2 = BoundingBox(Content=point_on_curve_2, Plane=PlaneXY(0, 0, 0), UnionBox=True)  # -> Box, Box_2
area_5 = Area(Geometry=bounding_box_2.Box)  # -> Area, Centroid
vector_2pt_2 = Vector2Pt(PointA=area_5.Centroid, PointB=point_on_curve_2, Unitize=False)  # -> Vector, Length
注釈長さ = Slider(929, range=0..2000)
vector_display_2 = VectorDisplay(Anchor=area_5.Centroid, Vector=vector_2pt_2.Vector)
line_sdl_3 = LineSDL(Start=point_on_curve_2, Direction=vector_2pt_2.Vector, Length=注釈長さ)
round_2 = Round(Number=length_2)  # -> Nearest, Floor, Ceiling
panel_28 = Panel(line_sdl_3)
文字サイズ_3 = Slider(300, range=0..1000)
concatenate_5 = Concatenate(Fragment_A=concatenate_3, A="　", Fragment_B=round_2.Nearest, B="mm")
marker_dimension_2 = MarkerDimension(Line=line_sdl_3, Text=concatenate_5, Size=文字サイズ_3)
panel_29 = Panel(concatenate_5)

# ----
# Excelファイルへの書き出し実行
# ①Excelファイルへの書き出しボタン
# ・ボタンを押した時だけTrueになり、書き出しが実行される。
# ・実行時に②で指定するファイルが既に存在する場合は
# 上書きされ、無い場合は新しく作成される。
# 【注意事項】
# 
# ●　②で指定したフォルダが存在しない場合、上手くいかない
# 
# ●　④の※が設定されてない場合、上手くいかない
# ②Excelファイルの作成フォルダとファイル名の指定
# この方法を使う場合、"c:\gh-excel\"はそのままとし、
# ファイル名を自身の「クラス-番号 氏名.xlsx」とする。
# ③Excelファイル内のワークシート名
# ④Excelファイル内での列の見出し
# （データのブランチと対応させる）
# ※Multiline Dataオプションを必ずオフに！
# ⑤Excelファイルへの出力データ
# ・ブランチと同じ数の列がExcel上で作成される。
# ⑥ここを"True"にしておくと、
# Excelファイルへの書き出し時に、
# ②で指定したファイルが既に存在し、且つ
# その中にデータが存在する場合、それらを
# 全てクリアした後にデータを出力する。
panel_30 = Panel("c:\gh-excel\3AA1-01 下川雄一.xlsx")
panel_31 = Panel("""部材名
部材番号
部材長(mm)
断面直径(mm)""")
entwine_2 = Entwine(Branch00=repeat_data, Branch01=flatten_tree_2, Branch02=integer, Branch03=repeat_data_2, FlattenInputs=True)
panel_32 = Panel(entwine_2)
excel_write = ExcelWrite(
    WriteExcelData=Button(),
    WorkbookPath=panel_30,
    WorksheetName="支柱鋼管リスト",
    ColumnHeadings=panel_31,
    Data=entwine_2,
    ClearSheet=Toggle(True))
panel_33 = Panel(excel_write)
