# Grasshopper definition 課題3 三宮プラッツ v0. .gh (Grasshopper 1.0.7)

series = Series(Start="10", Step="10", Count="840")
# XZ 中央山 放物線
# YZ 中央谷 双曲線
panel = Panel("3")
# (1*(x+0)^2+0)*(y-1)
panel_2 = Panel("10")
series_2 = Series(Start="1", Step="1", Count=panel)  # -> graft(Series)
series_3 = Series(Start=panel_2, Step=panel_2, Count="10")
panel_3 = Panel(series)
panel_4 = Panel(series_3)
graft_tree = GraftTree(Tree=series_3, IncludeEmptyLists=True, IncludeNullItems=True)
panel_5 = Panel(series_2)
graft_tree_2 = GraftTree(Tree=graft_tree, IncludeEmptyLists=True, IncludeNullItems=True)
panel_6 = Panel(graft_tree)
construct_point = ConstructPoint(XCoordinate=series_3, YCoordinate=graft_tree, ZCoordinate=graft_tree_2)
explode_tree = ExplodeTree()  # -> Branch0, Branch1
panel_7 = Panel(graft_tree_2)
evaluate = Evaluate(Expression="(x+3)*(y-1)", x=series, y=series_2)  # -> simplify(Result)
panel_8 = Panel(evaluate)
flip_matrix = FlipMatrix(Data=evaluate)
construct_point_2 = ConstructPoint(XCoordinate=series, YCoordinate=series_2, ZCoordinate=evaluate)
panel_9 = Panel(flip_matrix)
flip_matrix_2 = FlipMatrix(Data=construct_point_2)
panel_10 = Panel(construct_point_2)
interpolate = Interpolate(Vertices=flip_matrix_2, Degree=3, Periodic=False, KnotStyle=1)  # -> Curve, Length, Domain
interpolate_2 = Interpolate(Vertices=construct_point_2, Degree=3, Periodic=False, KnotStyle=1)  # -> Curve, Length, Domain
panel_11 = Panel(flip_matrix_2)
patch = Patch(Spans=20, Flexibility=1, Trim=True)
