# Grasshopper definition 課題3 三宮プラッツ v0.'.gh (Grasshopper 1.0.7)
# plug-ins: Kangaroo2 Components

galapagos = Galapagos()
expression = Expression(Expression="Format(\"{0}, {1}\", x, y)")

xy_plane = XYPlane(Origin=Point(0, 0, 0))
xz_plane = XZPlane(Origin=Point(0, 0, 0))
yz_plane = YZPlane(Origin=Point(0, 0, 0))

xy_plane_2 = XYPlane(Origin=Point(0, 0, 0))
xz_plane_2 = XZPlane(Origin=Point(0, 0, 0))
yz_plane_2 = YZPlane(Origin=Point(0, 0, 0))
number_slider = Slider(5, range=0..10)
square = Square(Plane=xy_plane, Size=Slider(1, range=0..2), ExtentX=number_slider, ExtentY=number_slider)  # -> Cells, Points
rectangle = Rectangle(square.Cells)
point = Point(square.Points)
panel = Panel(square.Cells)

gene_pool = GenePool(
    Decimals=2,
    Maximum=100,
    Minimum=0,
    Value=[53.14, 50.00483501, 50.60664004, 52.38937464, 52.12422765, 85.1256132, 77.98430849, 2.547985161, 61.93779353, 79.33574512])

populate_2d = Populate2D(Region={Plane=PlaneXY(0, 0, 0), Size=Domain2(u=0..20, v=0..10)}, Count=Slider(100, range=0..200), Seed=1)
construct_point = ConstructPoint(XCoordinate="5", YCoordinate="5", ZCoordinate="5")
point_2 = Point(populate_2d)
hexagonal = Hexagonal(Plane=PlaneXY(0, 0, 0), Size=1, ExtentX=5, ExtentY=5)  # -> Cells, Points
delaunay_edges = DelaunayEdges(Points=point_2, Plane=xy_plane)  # -> Connectivity, Edges
delaunay_mesh = DelaunayMesh(Points=point_2, Plane=PlaneXY(0, 0, 0))
line = Line(delaunay_edges.Edges)
face_boundaries = FaceBoundaries(Mesh=delaunay_mesh)
surface_box = SurfaceBox(Height=1)
panel_2 = Panel(delaunay_edges.Connectivity)
panel_3 = Panel(delaunay_mesh)
scale = Scale(Geometry=[face_boundaries, delaunay_mesh], Center=construct_point, Factor=Slider(1.5, range=0..2))  # -> Geometry, Transform

triremesh = TriRemesh(Iterations=25)  # -> Triangulation, Dual, Creases
fit_loft = FitLoft(CountU=15, DegreeU=5, DegreeV=5)

populate_3d = Populate3D(
    Region={Plane=PlaneXY(0, 0, 0), X=Domain(0, 10), Y=Domain(0, 10), Z=Domain(0, 2)},
    Count=Slider(100, range=0..200),
    Seed=1)
