# Grasshopper definition 課題3 三宮プラッツ v1.0.gh (Grasshopper 1.0.7)

# ----
# モニュメント生成範囲指定
# ここに直接平面データの埋め込みも可能 ↑
四隅の丸み = Panel("50")
正方形1辺の長さ = Panel("8400")
cluster = Cluster(length=正方形1辺の長さ, radius=四隅の丸み)
surface = Surface(cluster)

# ----
# 近似曲面生成式 要素値表
xy平面_軸回転角度 = Slider(45, range=-180..180)
x軸_曲率 = Panel("0.04")
x軸_頂点座標 = Panel("1000")
x軸_傾斜 = Panel("0.3")
z軸_移動補正 = Panel("0")
y軸_曲率 = Panel("0.06")
y軸_傾斜 = Panel("0.0")
厚み = Panel("50")
y軸_頂点座標 = Panel("0")

populate_geometry = PopulateGeometry(Geometry=surface, Count=Slider(200, range=0..200), Seed=Slider(1, range=1..10))
formula_for_z = Panel("( u*(x-a)^2 - v*(y-b)^2 )/10^3 + (d*x + e*y)")
rotate = Rotate(Geometry=populate_geometry, Angle=degrees(xy平面_軸回転角度), Plane=PlaneXY(0, 0, 0))  # -> Geometry, Transform
deconstruct = Deconstruct(Point=rotate.Geometry)  # -> XComponent, YComponent, ZComponent
evaluate = Evaluate(
    Expression=formula_for_z,
    x=deconstruct.XComponent,
    y=deconstruct.YComponent,
    u=x軸_曲率,
    v=y軸_曲率,
    a=x軸_頂点座標,
    b=y軸_頂点座標,
    d=x軸_傾斜,
    e=y軸_傾斜)
bounds = Bounds(Numbers=evaluate)
panel = Panel(evaluate)
deconstruct_domain = DeconstructDomain(Domain=bounds)  # -> Start, End
negative = Negative(Value=xy平面_軸回転角度)
subtraction = Subtraction(A=evaluate, B=deconstruct_domain.Start)
addition = Addition(A=subtraction, B=z軸_移動補正)
addition_2 = Addition(A=addition, B=厚み)
construct_point = ConstructPoint(XCoordinate=deconstruct.XComponent, YCoordinate=deconstruct.YComponent, ZCoordinate=addition)
construct_point_2 = ConstructPoint(XCoordinate=deconstruct.XComponent, YCoordinate=deconstruct.YComponent, ZCoordinate=addition_2)
convex_hull = ConvexHull(Points=construct_point, Plane=PlaneXY(0, 0, 0))  # -> Hull, HullZ, Indices
convex_hull_2 = ConvexHull(Points=construct_point_2, Plane=PlaneXY(0, 0, 0))  # -> Hull, HullZ, Indices
loft = Loft(
    Curves=[convex_hull.HullZ, convex_hull_2.HullZ],
    Options={Adjust=False, Closed=False, LoftEnds=0, LoftSimp=0, LoftType=0, Rebuild=10, Refit=0.01})
boundary_surfaces = BoundarySurfaces(Edges=convex_hull.Hull)
patch = Patch(Curves=convex_hull_2.HullZ, Spans=20, Flexibility=1, Trim=True)

delaunay_mesh = DelaunayMesh(Points=construct_point, Plane=PlaneXY(0, 0, 0))
panel_2 = Panel(delaunay_mesh)
face_boundaries = FaceBoundaries(Mesh=delaunay_mesh)

construct_point_3 = ConstructPoint(XCoordinate="0", YCoordinate="0", ZCoordinate="2500")
extrude_point = ExtrudePoint(Base=face_boundaries, Point=construct_point_3)

geometry = Geometry([loft, delaunay_mesh, patch])
rotate_2 = Rotate(Geometry=geometry, Angle=degrees(negative), Plane=PlaneXY(0, 0, 0))  # -> Geometry, Transform

# ==== cluster Cluster
length = ClusterInput()
radius = ClusterInput()
division = Division(A=length, B="2")
negative = Negative(Value=division)
construct_domain = ConstructDomain(DomainStart=division, DomainEnd=negative)
rectangle = Rectangle(Plane=PlaneXY(0, 0, 0), XSize=construct_domain, YSize=construct_domain, Radius=radius)  # -> Rectangle, Length
rectangle_2 = ClusterOutput(rectangle.Rectangle)
