# Grasshopper definition 課題3 学生症候群 三宮プラッツ.gh (Grasshopper 1.0.7)

# ----
# 生成範囲指定ブロック
# ここに直接平面データの埋め込みも可能 ↑
四隅丸み = Panel("50")
正方形1辺_長さ = Panel("8400")
cluster = Cluster(length=正方形1辺_長さ, radius=四隅丸み)
surface = Surface(cluster)

# ----
# 近似曲面生成式 要素値表
xy平面_回転角度 = Slider(45, range=-180..180)
z方向_基準高 = Panel("0")
u_x方向_曲率 = Slider(0.05, range=-0.1..0.1)
v_y方向_曲率 = Slider(-0.03, range=-0.1..0.1)
a_x方向_極点 = Slider(0, range=-5000..5000)
b_y方向_極点 = Slider(-500, range=-5000..5000)
d_x方向_傾斜 = Slider(0.2, range=-1..1)
e_y方向_傾斜 = Slider(0.3, range=-1..1)
モニュメント厚 = Panel("50")

生成点数 = Slider(200, range=0..200)
seed値 = Slider(1, range=1..10)

# ----
# 構成点群の空間座標算定ブロック
# xy平面に最低点を合わせるクラスター ↑
populate_geometry = PopulateGeometry(Geometry=surface, Count=生成点数, Seed=seed値)
formula_for_z = Panel("( u*(x-a)^2 + v*(y-b)^2 )/10^3 + (d*x + e*y)")
rotate = Rotate(Geometry=populate_geometry, Angle=degrees(xy平面_回転角度), Plane=PlaneXY(0, 0, 0))  # -> Geometry, Transform
deconstruct = Deconstruct(Point=rotate.Geometry)  # -> XComponent, YComponent, ZComponent
evaluate = Evaluate(
    Expression=formula_for_z,
    x=deconstruct.XComponent,
    y=deconstruct.YComponent,
    u=u_x方向_曲率,
    v=v_y方向_曲率,
    a=a_x方向_極点,
    b=b_y方向_極点,
    d=d_x方向_傾斜,
    e=e_y方向_傾斜)
panel = Panel(evaluate)
cluster_2 = Cluster_2(relay=evaluate, relay_2=z方向_基準高)

unit_z = UnitZ(Factor=モニュメント厚)
construct_point = ConstructPoint(XCoordinate=deconstruct.XComponent, YCoordinate=deconstruct.YComponent, ZCoordinate=cluster_2)

# ----
# 成形ブロック
convex_hull = ConvexHull(Points=construct_point, Plane=PlaneXY(0, 0, 0))  # -> Hull, HullZ, Indices
move = Move(Geometry=convex_hull.HullZ, Motion=unit_z)  # -> Geometry, Transform

negative = Negative(Value=xy平面_回転角度)

# ----
# (上から順に：
# 　小三角線群, 小三角面群, 側面, 包括曲面 の
# 　　　　　　　　　　　　　　　　　　　生成コンポーネント)
delaunay_edges = DelaunayEdges(Points=construct_point, Plane=PlaneXY(0, 0, 0))  # -> Connectivity, Edges
patch = Patch(Curves=move.Geometry, Spans=20, Flexibility=1, Trim=True)
平三角形群の生成コンポーネント = DelaunayMesh(Points=construct_point, Plane=PlaneXY(0, 0, 0))
loft = Loft(
    Curves=[convex_hull.HullZ, move.Geometry],
    Options={Adjust=False, Closed=False, LoftEnds=0, LoftSimp=0, LoftType=0, Rebuild=10, Refit=0.01})
geometry = Geometry([loft, patch, 平三角形群の生成コンポーネント, delaunay_edges.Edges])

rotate_2 = Rotate(Geometry=geometry, Angle=degrees(negative), Plane=PlaneXY(0, 0, 0))  # -> Geometry, Transform
# 完成！
geometry_2 = Geometry(rotate_2.Geometry)

# ==== cluster Cluster
length = ClusterInput()
radius = ClusterInput()
division = Division(A=length, B="2")
negative = Negative(Value=division)
construct_domain = ConstructDomain(DomainStart=division, DomainEnd=negative)
rectangle = Rectangle(Plane=PlaneXY(0, 0, 0), XSize=construct_domain, YSize=construct_domain, Radius=radius)  # -> Rectangle, Length
rectangle_2 = ClusterOutput(rectangle.Rectangle)

# ==== cluster Cluster_2
relay = ClusterInput()
bounds = Bounds(Numbers=relay)
deconstruct_domain = DeconstructDomain(Domain=bounds)  # -> Start, End
relay_2 = ClusterInput()
subtraction = Subtraction(A=relay, B=deconstruct_domain.Start)
addition = Addition(A=subtraction, B=relay_2)
result = ClusterOutput(addition)
