# Grasshopper definition 課題4 三宮プラッツ v2.-.gh (Grasshopper 1.0.7)
# plug-ins: Kangaroo2 Components

# ----
# モニュメント生成範囲指定ブロック
# ここに直接平面データの埋め込みも可能 ↑
四隅の丸み = Panel("50")
正方形1辺の長さ = Panel("8400")
cluster = Cluster(length=正方形1辺の長さ, radius=四隅の丸み)
surface = Surface(cluster)

# ----
# 近似曲面生成式 要素値表
xy平面_回転角度 = Slider(45, range=-180..180)
x方向_曲率 = Panel("0.05")
x方向_極点_mm = Panel("0")
x方向_傾斜 = Panel("0.0")
z方向_基準高 = Panel("0")
y方向_曲率 = Panel("-0.03")
y方向_傾斜 = Panel("0.3")
モニュメント厚 = Panel("50")
y方向_極点_mm = Panel("-500")

# ----
# 構成点群の空間座標算定ブロック
# xy平面に最低点を合わせるクラスター ↑
populate_geometry = PopulateGeometry(Geometry=surface, Count=Slider(200, range=0..200), Seed=Slider(1, range=1..10))
formula_for_z = Panel("( u*(x-a)^2 + v*(y-b)^2 )/10^3 + (d*x + e*y)")
rotate = Rotate(Geometry=populate_geometry, Angle=degrees(xy平面_回転角度), Plane=PlaneXY(0, 0, 0))  # -> Geometry, Transform
deconstruct = Deconstruct(Point=rotate.Geometry)  # -> XComponent, YComponent, ZComponent
evaluate = Evaluate(
    Expression=formula_for_z,
    x=deconstruct.XComponent,
    y=deconstruct.YComponent,
    u=x方向_曲率,
    v=y方向_曲率,
    a=x方向_極点_mm,
    b=y方向_極点_mm,
    d=x方向_傾斜,
    e=y方向_傾斜)
panel = Panel(evaluate)
cluster_2 = Cluster_2(relay=evaluate, relay_2=z方向_基準高)

unit_z = UnitZ(Factor=モニュメント厚)
triremesh = TriRemesh(Iterations=25)  # -> Triangulation, Dual, Creases
construct_point = ConstructPoint(XCoordinate=deconstruct.XComponent, YCoordinate=deconstruct.YComponent, ZCoordinate=cluster_2)

# ----
# モニュメント成形ブロック
convex_hull = ConvexHull(Points=construct_point, Plane=PlaneXY(0, 0, 0))  # -> Hull, HullZ, Indices
boundary_surfaces = BoundarySurfaces(Edges=convex_hull.Hull)
move = Move(Geometry=convex_hull.HullZ, Motion=unit_z)  # -> Geometry, Transform

negative = Negative(Value=xy平面_回転角度)

# ----
# (上から順に： 平面三角形群, 側面, 包括曲面)
patch = Patch(Curves=move.Geometry, Spans=20, Flexibility=1, Trim=True)
delaunay_mesh = DelaunayMesh(Points=construct_point, Plane=PlaneXY(0, 0, 0))
loft = Loft(
    Curves=[convex_hull.HullZ, move.Geometry],
    Options={Adjust=False, Closed=False, LoftEnds=0, LoftSimp=0, LoftType=0, Rebuild=10, Refit=0.01})
geometry = Geometry([loft, delaunay_mesh, patch])

construct_point_2 = ConstructPoint(XCoordinate="0", YCoordinate="0", ZCoordinate="2500")
face_boundaries = FaceBoundaries(Mesh=delaunay_mesh)
extrude_point = ExtrudePoint(Base=face_boundaries, Point=construct_point_2)

rotate_2 = Rotate(Geometry=geometry, Angle=degrees(negative), Plane=PlaneXY(0, 0, 0))  # -> Geometry, Transform

# ==== cluster Cluster
length = ClusterInput()
radius = ClusterInput()
division = Division(A=length, B="2")
negative = Negative(Value=division)
construct_domain = ConstructDomain(DomainStart=division, DomainEnd=negative)
rectangle = Rectangle(Plane=PlaneXY(0, 0, 0), XSize=construct_domain, YSize=construct_domain, Radius=radius)  # -> Rectangle, Length
rectangle_2 = ClusterOutput(rectangle.Rectangle)

# ==== cluster Cluster_2
relay = ClusterInput()
bounds = Bounds(Numbers=relay)
deconstruct_domain = DeconstructDomain(Domain=bounds)  # -> Start, End
relay_2 = ClusterInput()
subtraction = Subtraction(A=relay, B=deconstruct_domain.Start)
addition = Addition(A=subtraction, B=relay_2)
result = ClusterOutput(addition)
