# Grasshopper definition 課題4 三宮プラッツ v2.5.gh (Grasshopper 1.0.7)
# plug-ins: Kangaroo2 Components

# ----
# モニュメント生成範囲指定ブロック
# ここに直接平面データの埋め込みも可能 ↑
正方形1辺_長さ = Panel("8400")
四隅丸み = Panel("50")
cluster = Cluster(length=正方形1辺_長さ, radius=四隅丸み)
surface = Surface(cluster)

# ----
# 近似曲面生成式 要素値表
xy平面_回転角度 = Slider(45, range=-180..180)
z方向_基準高 = Panel("0")
y方向_曲率 = Slider(-0.03, range=-0.1..0.1)
x方向_曲率 = Slider(0.05, range=-0.1..0.1)
x方向_極点 = Slider(0, range=-5000..5000)
y方向_極点 = Slider(-500, range=-5000..5000)
x方向_傾斜 = Slider(0.2, range=-1..1)
y方向_傾斜 = Slider(0.3, range=-1..1)
モニュメント厚 = Panel("50")

一辺平均長さ = Panel("900")
triremesh = TriRemesh(Geometry=surface, Sharp=Toggle(True), Length=一辺平均長さ, Iterations=25)  # -> Triangulation, Dual, Creases
deconstruct_mesh = DeconstructMesh(Mesh=triremesh.Triangulation)  # -> flatten(Vertices), Faces, Colours, Normals

# ----
# 構成点群の空間座標算定ブロック
# xy平面に最低点を合わせるクラスター ↑
formula_for_z = Panel("( u*(x-a)^2 + v*(y-b)^2 )/10^3 + (d*x + e*y)")
rotate = Rotate(Geometry=deconstruct_mesh.Vertices, Angle=degrees(xy平面_回転角度), Plane=PlaneXY(0, 0, 0))  # -> Geometry, Transform
deconstruct = Deconstruct(Point=rotate.Geometry)  # -> XComponent, YComponent, ZComponent
evaluate = Evaluate(
    Expression=formula_for_z,
    x=deconstruct.XComponent,
    y=deconstruct.YComponent,
    u=x方向_曲率,
    v=y方向_曲率,
    a=x方向_極点,
    b=y方向_極点,
    d=x方向_傾斜,
    e=y方向_傾斜)
panel = Panel(evaluate)
cluster_2 = Cluster_2(relay=evaluate, relay_2=z方向_基準高)

平三角形群の生成コンポーネント = DelaunayMesh(Points=rotate.Geometry, Plane=PlaneXY(0, 0, 0))
unit_z = UnitZ(Factor=モニュメント厚)
construct_point = ConstructPoint(XCoordinate=deconstruct.XComponent, YCoordinate=deconstruct.YComponent, ZCoordinate=cluster_2)

# ----
# モニュメント成形ブロック
convex_hull = ConvexHull(Points=construct_point, Plane=PlaneXY(0, 0, 0))  # -> Hull, HullZ, Indices
move = Move(Geometry=convex_hull.HullZ, Motion=unit_z)  # -> Geometry, Transform

triremesh_2 = TriRemesh(Geometry=convex_hull.HullZ, Sharp=Toggle(True), Length=Slider(730, range=200..2000), Iterations=25)  # -> Triangulation, Dual, Creases
settings_custom = SettingsCustom(
    StitchSeams=True,
    SimplePlanes=False,
    Refine=True,
    MinCount=16,
    MaxCount=400,
    AspectRatio=20,
    MaxDistance=0,
    MaxAngle=20,
    MinEdge=0,
    MaxEdge=0)
tree_statistics = TreeStatistics()  # -> Paths, Length, Count
geometry = Geometry(triremesh_2.Triangulation)
boundary_surfaces = BoundarySurfaces(Edges=convex_hull.Hull)
mesh_brep = MeshBrep(Settings={GridMaxCount=0, GridMinCount=16, JaggedSeams=False, MaxEdgeLength=0, MinEdgeLength=0.0001, MinTolerance=0, Refine=True, RefineAngle=0, RelativeTolerance=0.65, SimplePlanes=True, Tolerance=0})
negative = Negative(Value=xy平面_回転角度)
construct_mesh = ConstructMesh(Vertices=[Point(0, 0, 0), Point(10, 0, 0), Point(10, 10, 0), Point(0, 10, 0)], Faces={A=0, B=1, C=2, D=3})
face_boundaries = FaceBoundaries(Mesh=triremesh_2.Triangulation)
deconstruct_mesh_2 = DeconstructMesh(Mesh=triremesh_2.Triangulation)  # -> Vertices, Faces, Colours, Normals
orient = Orient(Source=PlaneXY(0, 0, 0), Target=PlaneXY(0, 0, 0))  # -> Geometry, Transform

# ----
# (上から順に：
# 　三角形の線群, 小平面群, 側面, 包括曲面 の
# 　　　　　　　　　　　　　　　　　　　生成コンポーネント)
delaunay_edges = DelaunayEdges(Points=construct_point, Plane=PlaneXY(0, 0, 0))  # -> Connectivity, flatten(Edges)
patch = Patch(Curves=move.Geometry, Spans=20, Flexibility=1, Trim=True)
平三角形群の生成コンポーネント_2 = DelaunayMesh(Points=construct_point, Plane=PlaneXY(0, 0, 0))
loft = Loft(
    Curves=[convex_hull.HullZ, move.Geometry],
    Options={Adjust=False, Closed=False, LoftEnds=0, LoftSimp=0, LoftType=0, Rebuild=10, Refit=0.01})
geometry_2 = Geometry([loft, patch, 平三角形群の生成コンポーネント_2, delaunay_edges.Edges])

mesh_triangle = MeshTriangle(CornerA=0, CornerB=1, CornerC=2)
panel_2 = Panel(face_boundaries)
disjoint_mesh = DisjointMesh(Mesh=平三角形群の生成コンポーネント_2)  # -> simplify(Meshes)
geometry_3 = Geometry(face_boundaries)
surface_2 = Surface(face_boundaries)
data = Data(deconstruct_mesh_2.Vertices)
panel_3 = Panel(deconstruct_mesh_2.Vertices)
list_item = ListItem(List=surface_2, Index=Slider(605, range=0..1000), Wrap=True)
panel_4 = Panel(disjoint_mesh)

# ----
# 完成！
rotate_2 = Rotate(Geometry=geometry_2, Angle=degrees(negative), Plane=PlaneXY(0, 0, 0))  # -> Geometry, Transform
geometry_4 = Geometry(rotate_2.Geometry)

panel_5 = Panel(surface_2)
colour_swatch = ColourSwatch(SwatchColor=RGB(255, 255, 255))
face_boundaries_2 = FaceBoundaries(Mesh=平三角形群の生成コンポーネント)
face_boundaries_3 = FaceBoundaries(Mesh=平三角形群の生成コンポーネント_2)
surface_3 = Surface(flatten(face_boundaries_2))
surface_4 = Surface(flatten(face_boundaries_3))
area = Area(Geometry=surface_4)  # -> Area, Centroid
point = Point(Point(8000, -4000, 0))
rectangular = Rectangular(Plane=point, SizeX="1000", SizeY="1000", ExtentX=10, ExtentY=5)  # -> Cells, Points
list_length = ListLength(List=surface_4)
deconstruct_2 = Deconstruct(Point=area.Centroid)  # -> XComponent, YComponent, ZComponent
subtraction = Subtraction(A=list_length, B="1")
entwine = Entwine(Branch0X=area.Area, Branch1X=area.Centroid, Branch2X=surface_3, Branch3X=surface_4, FlattenInputs=False)
addition = Addition(A=deconstruct_2.XComponent, B=deconstruct_2.YComponent)
multiplication = Multiplication(A=subtraction, B=Slider(0.888644, range=0..1))
sort_list = SortList(Keys=addition, ValuesValuesA=entwine)  # -> Keys, ValuesValuesA
integer = Integer(multiplication)
cherry_picker = CherryPicker(ListIndex=0, TreePath_path="{3;0}")
tree_statistics_2 = TreeStatistics()  # -> Paths, Length, Count
panel_6 = Panel(integer)
list_item_2 = ListItem(List=sort_list.ValuesValuesA, Index=integer, Wrap=True)
shift_paths = ShiftPaths(Data=sort_list.ValuesValuesA, Offset=-1)
surface_5 = Panel("{3}")
panel_7 = Panel(cherry_picker)
geometry_5 = Geometry(cherry_picker)
tree_branch = TreeBranch(Tree=shift_paths, Path=surface_5, MaintainPaths=True)
panel_8 = Panel(list_item_2)
panel_9 = Panel(shift_paths)
face_boundaries_4 = FaceBoundaries(Mesh=tree_branch)  # -> flatten(Boundaries)
number_slider = Slider(0, range=0..7)
surface_6 = Panel("{3;179}")
geometry_6 = Geometry(face_boundaries_4)
tree_branch_2 = TreeBranch(Tree=face_boundaries_4, MaintainPaths=True)
length = Length(Curve=geometry_6)
list_item_3 = ListItem(List=length, Index=number_slider, Wrap=True)
list_item_4 = ListItem(List=tree_branch_2, Index=number_slider, Wrap=True)
geometry_7 = Geometry(list_item_3)
panel_10 = Panel(length)
triangle_trigonometry = TriangleTrigonometry()  # -> Alpha, Beta, Gamma, ALength, BLength, CLength

# ==== cluster Cluster
length = ClusterInput()
radius = ClusterInput()
division = Division(A=length, B="2")
negative = Negative(Value=division)
construct_domain = ConstructDomain(DomainStart=division, DomainEnd=negative)
rectangle = Rectangle(Plane=PlaneXY(0, 0, 0), XSize=construct_domain, YSize=construct_domain, Radius=radius)  # -> Rectangle, Length
rectangle_2 = ClusterOutput(rectangle.Rectangle)

# ==== cluster Cluster_2
relay = ClusterInput()
bounds = Bounds(Numbers=relay)
deconstruct_domain = DeconstructDomain(Domain=bounds)  # -> Start, End
relay_2 = ClusterInput()
subtraction = Subtraction(A=relay, B=deconstruct_domain.Start)
addition = Addition(A=subtraction, B=relay_2)
result = ClusterOutput(addition)
