# Grasshopper definition 課題4 三宮プラッツ v3.0 (三角形3辺長さリスト完成).gh (Grasshopper 1.0.7)
# plug-ins: Kangaroo2 Components, LunchBox

# ----
# モニュメント生成範囲指定ブロック
# ここに直接平面データの埋め込みも可能 ↑
正方形1辺_長さ = Panel("8400")
四隅丸み = Panel("50")
cluster = Cluster(length=正方形1辺_長さ, radius=四隅丸み)
surface = Surface(cluster)

# ----
# 近似曲面生成式 要素値表
xy平面_回転角度 = Slider(45, range=-180..180)
z方向_基準高 = Panel("0")
y方向_曲率 = Slider(-0.03, range=-0.1..0.1)
x方向_曲率 = Slider(0.05, range=-0.1..0.1)
x方向_極点 = Slider(0, range=-5000..5000)
y方向_極点 = Slider(-500, range=-5000..5000)
x方向_傾斜 = Slider(0.2, range=-1..1)
y方向_傾斜 = Slider(0.3, range=-1..1)
モニュメント厚 = Panel("50")

三角鏡_辺長さ設定値 = Panel("900")
triremesh = TriRemesh(Geometry=surface, Sharp=Toggle(True), Length=三角鏡_辺長さ設定値, Iterations=25)  # -> Triangulation, Dual, Creases
deconstruct_mesh = DeconstructMesh(Mesh=triremesh.Triangulation)  # -> flatten(Vertices), Faces, Colours, Normals

# ----
# 構成点群の空間座標算定ブロック
# xy平面に最低点を合わせるクラスター ↑
formula_for_z = Panel("( u*(x-a)^2 + v*(y-b)^2 )/10^3 + (d*x + e*y)")
rotate = Rotate(Geometry=deconstruct_mesh.Vertices, Angle=degrees(xy平面_回転角度), Plane=PlaneXY(0, 0, 0))  # -> Geometry, Transform
deconstruct = Deconstruct(Point=rotate.Geometry)  # -> XComponent, YComponent, ZComponent
evaluate = Evaluate(
    Expression=formula_for_z,
    x=deconstruct.XComponent,
    y=deconstruct.YComponent,
    u=x方向_曲率,
    v=y方向_曲率,
    a=x方向_極点,
    b=y方向_極点,
    d=x方向_傾斜,
    e=y方向_傾斜)
panel = Panel(evaluate)
cluster_2 = Cluster_2(relay=evaluate, relay_2=z方向_基準高)

平三角形群の生成コンポーネント = DelaunayMesh(Points=rotate.Geometry, Plane=PlaneXY(0, 0, 0))

# ----
# ８．支柱の部材一覧表の作成
# 設計者が部材制作を行うメーカーに部材情報を
# 分かり易く渡すための情報連携作業を想定した
# 部材一覧表を作成する。
# 部材に番付を行い、モデル中と表中の両方に
# 表示することで情報の紐づけが容易にしている。
# 支柱の形状データを分解し、
# ブランチを位置毎から
# フロア毎に組み替え
# 支柱の向きを区別
# するブランチを削除
# フロア毎に組み替えた支柱の基準線
deconstruct_brep = DeconstructBrep()  # -> simplify(Faces), Edges, Vertices
panel_2 = Panel(deconstruct_brep.Faces)
cherry_picker = CherryPicker(deconstruct_brep.Faces, ListIndex=0, TreePath_path="{0;0}")
path_mapper = PathMapper(deconstruct_brep.Faces, source="{xy;dir}(fl)", target="{fl;dir}(xy)")
panel_3 = Panel(path_mapper)
cherry_picker_2 = CherryPicker(path_mapper, ListIndex=0, TreePath_path="{0;0}")
trim_tree = TrimTree(Tree=path_mapper, Depth=1)
リスト内情報 = Panel(trim_tree)
cherry_picker_3 = CherryPicker(trim_tree, ListIndex=0, TreePath_path="{0}")

# ----
# ブランチのデータ個数から一覧表の行列数を求める
tree_statistics = TreeStatistics()  # -> Paths, Length, Count
panel_4 = Panel(tree_statistics.Paths)
panel_5 = Panel(tree_statistics.Count)
list_item = ListItem(List=tree_statistics.Length, Index="0", Wrap=True)
panel_6 = Panel(tree_statistics.Length)
表の列数_x = Number(list_item)
表の行数_y = Number(tree_statistics.Count)

unit_z = UnitZ(Factor=モニュメント厚)

# ----
# 表の枠線を作成
number_slider = Slider(5142, range=0..10000)
point = Point(Point(13289.97432, -19621.88377, 0))
rectangular = Rectangular(Plane=point, SizeX=number_slider, SizeY=Slider(10000, range=0..10000), ExtentX=表の列数_x, ExtentY=表の行数_y)  # -> Cells, Points
panel_7 = Panel(rectangular.Cells)
flip_matrix = FlipMatrix(Data=rectangular.Cells)
panel_8 = Panel(flip_matrix)

construct_point = ConstructPoint(XCoordinate=deconstruct.XComponent, YCoordinate=deconstruct.YComponent, ZCoordinate=cluster_2)

# ----
# モニュメント成形ブロック
convex_hull = ConvexHull(Points=construct_point, Plane=PlaneXY(0, 0, 0))  # -> Hull, HullZ, Indices
move = Move(Geometry=convex_hull.HullZ, Motion=unit_z)  # -> Geometry, Transform

triremesh_2 = TriRemesh(Geometry=convex_hull.HullZ, Sharp=Toggle(True), Length=Slider(730, range=200..2000), Iterations=25)  # -> Triangulation, Dual, Creases
settings_custom = SettingsCustom(
    StitchSeams=True,
    SimplePlanes=False,
    Refine=True,
    MinCount=16,
    MaxCount=400,
    AspectRatio=20,
    MaxDistance=0,
    MaxAngle=20,
    MinEdge=0,
    MaxEdge=0)

# ----
# 支柱の番付
panel_9 = Panel("1")
series = Series(Start=panel_9, Step=panel_9, Count=表の行数_y)
panel_10 = Panel(series)
concatenate = Concatenate(FragmentA=series, FragmentB="FL")  # -> graft(Result)
series_2 = Series(Start="1", Step="1", Count=表の列数_x)
panel_11 = Panel(concatenate)
panel_12 = Panel(series_2)
concatenate_2 = Concatenate(FragmentA=concatenate, FragmentB=series_2)  # -> simplify(Result)
panel_13 = Panel(concatenate_2)

tree_statistics_2 = TreeStatistics()  # -> Paths, Length, Count
geometry = Geometry(triremesh_2.Triangulation)
boundary_surfaces = BoundarySurfaces(Edges=convex_hull.Hull)
mesh_brep = MeshBrep(Settings={GridMaxCount=0, GridMinCount=16, JaggedSeams=False, MaxEdgeLength=0, MinEdgeLength=0.0001, MinTolerance=0, Refine=True, RefineAngle=0, RelativeTolerance=0.65, SimplePlanes=True, Tolerance=0})
negative = Negative(Value=xy平面_回転角度)
construct_mesh = ConstructMesh(Vertices=[Point(0, 0, 0), Point(10, 0, 0), Point(10, 10, 0), Point(0, 10, 0)], Faces={A=0, B=1, C=2, D=3})
face_boundaries = FaceBoundaries(Mesh=triremesh_2.Triangulation)
deconstruct_mesh_2 = DeconstructMesh(Mesh=triremesh_2.Triangulation)  # -> Vertices, Faces, Colours, Normals
orient = Orient(Source=PlaneXY(0, 0, 0), Target=PlaneXY(0, 0, 0))  # -> Geometry, Transform

# ----
# (上から順に：
# 　三角形の線群, 小平面群, 側面, 包括曲面 の
# 　　　　　　　　　　　　　　　　　　　生成コンポーネント)
delaunay_edges = DelaunayEdges(Points=construct_point, Plane=PlaneXY(0, 0, 0))  # -> Connectivity, flatten(Edges)
patch = Patch(Curves=move.Geometry, Spans=20, Flexibility=1, Trim=True)
平三角形群の生成コンポーネント_2 = DelaunayMesh(Points=construct_point, Plane=PlaneXY(0, 0, 0))
loft = Loft(
    Curves=[convex_hull.HullZ, move.Geometry],
    Options={Adjust=False, Closed=False, LoftEnds=0, LoftSimp=0, LoftType=0, Rebuild=10, Refit=0.01})
geometry_2 = Geometry([loft, patch, 平三角形群の生成コンポーネント_2, delaunay_edges.Edges])

mesh_triangle = MeshTriangle(CornerA=0, CornerB=1, CornerC=2)
panel_14 = Panel(face_boundaries)
disjoint_mesh = DisjointMesh(Mesh=平三角形群の生成コンポーネント_2)  # -> simplify(Meshes)
geometry_3 = Geometry(face_boundaries)
surface_2 = Surface(face_boundaries)
data = Data(deconstruct_mesh_2.Vertices)
panel_15 = Panel(deconstruct_mesh_2.Vertices)
list_item_2 = ListItem(List=surface_2, Index=Slider(605, range=0..1000), Wrap=True)
panel_16 = Panel(disjoint_mesh)

# ----
# 完成！
rotate_2 = Rotate(Geometry=geometry_2, Angle=degrees(negative), Plane=PlaneXY(0, 0, 0))  # -> Geometry, Transform
geometry_4 = Geometry(rotate_2.Geometry)

panel_17 = Panel(surface_2)
colour_swatch = ColourSwatch(SwatchColor=RGB(255, 255, 255))

# ----
# 支柱を配置するための基準線を支柱の中心線の長さから作成
length = Length()
area = Area(Geometry=flip_matrix)  # -> Area, Centroid
panel_18 = Panel(length)
unit_y = UnitY(Factor=1)
division = Division(A=length, B=2)
negative_2 = Negative(Value=division)
line_sdl = LineSDL(Start=area.Centroid, Direction=unit_y, Length=length)
panel_19 = Panel(division)
unit_y_2 = UnitY(Factor=negative_2)
move_2 = Move(Geometry=line_sdl, Motion=unit_y_2)  # -> Geometry, Transform

# ----
# surfaceデータタイプでリスト化を行うブロック
face_boundaries_2 = FaceBoundaries(Mesh=平三角形群の生成コンポーネント)
face_boundaries_3 = FaceBoundaries(Mesh=平三角形群の生成コンポーネント_2)
surface_3 = Surface(flatten(face_boundaries_2))
surface_4 = Surface(flatten(face_boundaries_3))

deconstruct_brep_2 = DeconstructBrep(Brep=surface_4)  # -> Faces, Edges, Vertices
shift_paths = ShiftPaths(Data=deconstruct_brep_2.Edges, Offset="1")
length_2 = Length(Curve=shift_paths)

# ----
# 支柱オブジェクトを、
# モデル内基準線から表内基準線に
# 位置合わせする
orient_2 = Orient(Geometry=trim_tree, Source=PlaneXY(0, 0, 0), Target=move_2.Geometry)  # -> Geometry, Transform

delaunay_edges_2 = DelaunayEdges(Plane=PlaneXY(0, 0, 0))  # -> Connectivity, flatten(Edges)
panel_20 = Panel(length_2)

# ----
# 表内での支柱の番付と直径の表示
# 一覧表内：部材番号
# 一覧表内：鋼管直径
panel_21 = Panel("0")
文字サイズ = Slider(300, range=0..1000)
evaluate_box = EvaluateBox(Box=flip_matrix, UParameter="0.5", VParameter=panel_21, WParameter=0.5)  # -> Plane, Point, Include
unit_y_3 = UnitY(Factor=文字サイズ)
move_3 = Move(Geometry=evaluate_box.Point, Motion=unit_y_3)  # -> Geometry, Transform
multiplication = Multiplication(B=2)
unit_y_4 = UnitY(Factor="800")
move_4 = Move(Geometry=move_3.Geometry, Motion=unit_y_4)  # -> Geometry, Transform
concatenate_3 = Concatenate(FragmentA="Φ=", FragmentB=multiplication)
text_tag_3d = TextTag3D(Location=move_3.Geometry, Text=concatenate_2, Size=文字サイズ, Justification=5)
text_tag_3d_2 = TextTag3D(Location=move_4.Geometry, Text=concatenate_3, Size=文字サイズ, Justification=5)

cherry_picker_4 = CherryPicker(ListIndex=0, TreePath_path="{3;0}")
tree_statistics_3 = TreeStatistics()  # -> Paths, Length, Count

# ----
# 支柱の中心線の長さから寸法線を作成
# 一覧表内：部材長寸法
number_slider_2 = Slider(500, range=0..1000)
文字サイズ_2 = Slider(300, range=0..1000)
end_points = EndPoints(Curve=move_2.Geometry)  # -> Start, End
xy_plane = XYPlane(Origin=Point(0, 0, 0))
aligned_dimension = AlignedDimension(Plane=xy_plane, PointA=end_points.Start, PointB=end_points.End, Offset=number_slider_2, Text="{0:0}", Size=文字サイズ_2)

panel_22 = Panel(cherry_picker_4)
geometry_5 = Geometry(cherry_picker_4)
surface_5 = Panel("{3}")

# ----
# Excelに書き出す部材データの準備
# データの複製とリスト化
# 支柱の数のカウント
# 支柱の番付リストを単純化
# 支柱の基準線リストを単純化
# 小数点以下を四捨五入
# データの複製とリスト化
flatten_tree = FlattenTree(Path="{0}")
panel_24 = Panel(flatten_tree)
flatten_tree_2 = FlattenTree(Path="{0}")
length_3 = Length(Curve=flatten_tree)
# １０．部材情報のExcelファイルへの書き出し
panel_25 = Panel(flatten_tree_2)
panel_26 = Panel(length_3)
integer = Integer(length_3)
list_length = ListLength(List=flatten_tree_2)
panel_27 = Panel(integer)
multiplication_2 = Multiplication(B="2")
repeat_data = RepeatData(Data="鋼管", Length=list_length)
repeat_data_2 = RepeatData(Data=multiplication_2, Length=list_length)
panel_28 = Panel(repeat_data)
panel_29 = Panel(repeat_data_2)

triangle_trigonometry = TriangleTrigonometry()  # -> Alpha, Beta, Gamma, ALength, BLength, CLength

# ----
# Excelファイルへの書き出し実行
# ①Excelファイルへの書き出しボタン
# ・ボタンを押した時だけTrueになり、書き出しが実行される。
# ・実行時に②で指定するファイルが既に存在する場合は
# 上書きされ、無い場合は新しく作成される。
# 【注意事項】
# 
# ●　②で指定したフォルダが存在しない場合、上手くいかない
# 
# ●　④の※が設定されてない場合、上手くいかない
# ②Excelファイルの作成フォルダとファイル名の指定
# この方法を使う場合、"c:\gh-excel\"はそのままとし、
# ファイル名を自身の「クラス-番号 氏名.xlsx」とする。
# ③Excelファイル内のワークシート名
# ④Excelファイル内での列の見出し
# （データのブランチと対応させる）
# ※Multiline Dataオプションを必ずオフに！
# ⑤Excelファイルへの出力データ
# ・ブランチと同じ数の列がExcel上で作成される。
# ⑥ここを"True"にしておくと、
# Excelファイルへの書き出し時に、
# ②で指定したファイルが既に存在し、且つ
# その中にデータが存在する場合、それらを
# 全てクリアした後にデータを出力する。
panel_30 = Panel("c:\gh-excel\3AA1-01 下川雄一.xlsx")
panel_31 = Panel("""部材名
部材番号
部材長(mm)
断面直径(mm)""")
entwine = Entwine(Branch00=repeat_data, Branch01=flatten_tree_2, Branch02=integer, Branch03=repeat_data_2, FlattenInputs=True)
panel_32 = Panel(entwine)
excel_write = ExcelWrite(
    WriteExcelData=Button(),
    WorkbookPath=panel_30,
    WorksheetName="支柱鋼管リスト",
    ColumnHeadings=panel_31,
    Data=entwine,
    ClearSheet=Toggle(True))
panel_33 = Panel(excel_write)

# ----
# データ情報整理ブロック
area_2 = Area(Geometry=surface_4)  # -> Area, Centroid
list_length_2 = ListLength(List=surface_4)
deconstruct_2 = Deconstruct(Point=area_2.Centroid)  # -> XComponent, YComponent, ZComponent
entwine_2 = Entwine(Branch0X=area_2.Area, Branch1X=area_2.Centroid, Branch2X=surface_3, Branch3X=surface_4, FlattenInputs=False)
addition = Addition(A=deconstruct_2.XComponent, B=deconstruct_2.YComponent)
sort_list = SortList(Keys=addition, ValuesValuesA=entwine_2)  # -> Keys, ValuesValuesA
shift_paths_2 = ShiftPaths(Data=sort_list.ValuesValuesA, Offset=-1)

鏡面数 = Panel(list_length_2)

# ----
# 格子生成ブロック
panel_34 = Panel("1.2")
multiplication_3 = Multiplication(A=三角鏡_辺長さ設定値, B=panel_34)
evaluate_2 = Evaluate(Expression="(x/y)^½ +0.499", x=鏡面数, y="2")
integer_2 = Integer(evaluate_2)
multiplication_4 = Multiplication(A=integer_2, B="2")
point_2 = Point(Point(8000, -4000, 0))
rectangular_2 = Rectangular(Plane=point_2, SizeX=multiplication_3, SizeY=multiplication_3, ExtentX=multiplication_4, ExtentY=integer_2)  # -> Cells, Points

subtraction = Subtraction(A=鏡面数, B="1")
multiplication_5 = Multiplication(A=subtraction, B=Slider(0, range=0..1))
integer_3 = Integer(multiplication_5)
抽出鏡面no = Panel(integer_3)
list_item_3 = ListItem(List=shift_paths_2, Index=integer_3, Wrap=True)
panel_35 = Panel(list_item_3)

tree_branch = TreeBranch(Tree=shift_paths_2, Path=surface_5, MaintainPaths=True)
panel_36 = Panel(tree_branch)

# ==== cluster Cluster
length = ClusterInput()
radius = ClusterInput()
division = Division(A=length, B="2")
negative = Negative(Value=division)
construct_domain = ConstructDomain(DomainStart=division, DomainEnd=negative)
rectangle = Rectangle(Plane=PlaneXY(0, 0, 0), XSize=construct_domain, YSize=construct_domain, Radius=radius)  # -> Rectangle, Length
rectangle_2 = ClusterOutput(rectangle.Rectangle)

# ==== cluster Cluster_2
relay = ClusterInput()
bounds = Bounds(Numbers=relay)
deconstruct_domain = DeconstructDomain(Domain=bounds)  # -> Start, End
relay_2 = ClusterInput()
subtraction = Subtraction(A=relay, B=deconstruct_domain.Start)
addition = Addition(A=subtraction, B=relay_2)
result = ClusterOutput(addition)
