# Grasshopper definition 課題4 三宮プラッツ v3.8 (Entwine Breakthrough).gh (Grasshopper 1.0.7)
# plug-ins: Kangaroo2 Components, LunchBox

# ----
# モニュメント生成範囲指定ブロック
# ここに直接平面データの埋め込みも可能 ↑
正方形1辺_長さ = Panel("8400")
四隅丸み = Panel("50")
cluster = Cluster(length=正方形1辺_長さ, radius=四隅丸み)
surface = Surface(cluster)

# ----
# 近似曲面生成式 要素値表
xy平面_回転角度 = Slider(45, range=-180..180)
z方向_基準高 = Panel("0")
y方向_曲率 = Slider(-0.03, range=-0.1..0.1)
x方向_曲率 = Slider(0.05, range=-0.1..0.1)
x方向_極点 = Slider(0, range=-5000..5000)
y方向_極点 = Slider(-500, range=-5000..5000)
x方向_傾斜 = Slider(0.2, range=-1..1)
y方向_傾斜 = Slider(0.3, range=-1..1)
モニュメント厚 = Panel("50")

settings_custom = SettingsCustom(
    StitchSeams=True,
    SimplePlanes=False,
    Refine=True,
    MinCount=16,
    MaxCount=400,
    AspectRatio=20,
    MaxDistance=0,
    MaxAngle=20,
    MinEdge=0,
    MaxEdge=0)
boolean_toggle = BooleanToggle(True)  # disabled
number_slider = Slider(730, range=200..2000)  # disabled
tree_statistics = TreeStatistics()  # -> Paths, Length, Count
mesh_brep = MeshBrep(Settings={GridMaxCount=0, GridMinCount=16, JaggedSeams=False, MaxEdgeLength=0, MinEdgeLength=0.0001, MinTolerance=0, Refine=True, RefineAngle=0, RelativeTolerance=0.65, SimplePlanes=True, Tolerance=0})
mesh_triangle = MeshTriangle(CornerA=0, CornerB=1, CornerC=2)
construct_mesh = ConstructMesh(Vertices=[Point(0, 0, 0), Point(10, 0, 0), Point(10, 10, 0), Point(0, 10, 0)], Faces={A=0, B=1, C=2, D=3})
colour_swatch = ColourSwatch(SwatchColor=RGB(255, 255, 255))
cherry_picker = CherryPicker(ListIndex=0, TreePath_path="{3;0}")
tree_statistics_2 = TreeStatistics()  # -> Paths, Length, Count

# ----
# ８．支柱の部材一覧表の作成
# 支柱を配置するための基準線を支柱の中心線の長さから作成
# フロア毎に組み替えた支柱の基準線
length = Length()
area = Area()  # -> Area, Centroid
panel = Panel(length)
unit_y = UnitY(Factor=1)
division = Division(A=length, B=2)
negative = Negative(Value=division)
line_sdl = LineSDL(Start=area.Centroid, Direction=unit_y, Length=length)
panel_2 = Panel(division)
unit_y_2 = UnitY(Factor=negative)
move = Move(Geometry=line_sdl, Motion=unit_y_2)  # -> Geometry, Transform

panel_3 = Panel(cherry_picker)
geometry = Geometry(cherry_picker)

# ----
# 支柱オブジェクトを、
# モデル内基準線から表内基準線に
# 位置合わせする
orient = Orient(Source=PlaneXY(0, 0, 0), Target=move.Geometry)  # -> Geometry, Transform

# ----
# 表内での支柱の番付と直径の表示
# 一覧表内：部材番号
# 一覧表内：鋼管直径
panel_4 = Panel("0")
文字サイズ = Slider(300, range=0..1000)
evaluate_box = EvaluateBox(UParameter="0.5", VParameter=panel_4, WParameter=0.5)  # -> Plane, Point, Include
unit_y_3 = UnitY(Factor=文字サイズ)
move_2 = Move(Geometry=evaluate_box.Point, Motion=unit_y_3)  # -> Geometry, Transform
multiplication = Multiplication(B=2)
unit_y_4 = UnitY(Factor="800")
move_3 = Move(Geometry=move_2.Geometry, Motion=unit_y_4)  # -> Geometry, Transform
concatenate = Concatenate(FragmentA="Φ=", FragmentB=multiplication)
text_tag_3d = TextTag3D(Location=move_2.Geometry, Size=文字サイズ, Justification=5)
text_tag_3d_2 = TextTag3D(Location=move_3.Geometry, Text=concatenate, Size=文字サイズ, Justification=5)

# ----
# 支柱の中心線の長さから寸法線を作成
# 一覧表内：部材長寸法
number_slider_2 = Slider(500, range=0..1000)
文字サイズ_2 = Slider(300, range=0..1000)
end_points = EndPoints(Curve=move.Geometry)  # -> Start, End
xy_plane = XYPlane(Origin=Point(0, 0, 0))
aligned_dimension = AlignedDimension(Plane=xy_plane, PointA=end_points.Start, PointB=end_points.End, Offset=number_slider_2, Text="{0:0}", Size=文字サイズ_2)

# ----
# Excelに書き出す部材データの準備
# データの複製とリスト化
# 支柱の数のカウント
# 支柱の番付リストを単純化
# 支柱の基準線リストを単純化
# 小数点以下を四捨五入
# データの複製とリスト化
flatten_tree = FlattenTree(Path="{0}")
panel_5 = Panel(flatten_tree)
flatten_tree_2 = FlattenTree(Path="{0}")
length_2 = Length(Curve=flatten_tree)
# １０．部材情報のExcelファイルへの書き出し
panel_6 = Panel(flatten_tree_2)
panel_7 = Panel(length_2)
integer = Integer(length_2)
list_length = ListLength(List=flatten_tree_2)
panel_8 = Panel(integer)
multiplication_2 = Multiplication(B="2")
repeat_data = RepeatData(Data="鋼管", Length=list_length)
repeat_data_2 = RepeatData(Data=multiplication_2, Length=list_length)
panel_9 = Panel(repeat_data)
panel_10 = Panel(repeat_data_2)

panel_11 = Panel("""{4;0}
{4;1}
{4;2}
{2}""")
insert_items = InsertItems(Wrap=True)
explode_tree = ExplodeTree()  # -> Branch0, Branch1, Branch2, Branch3
deconstruct = Deconstruct(Point=explode_tree.Branch1)  # -> flatten(XComponent), flatten(YComponent), flatten(ZComponent)
integer_2 = Integer(deconstruct.XComponent)
integer_3 = Integer(deconstruct.YComponent)
integer_4 = Integer(deconstruct.ZComponent)
relay = Relay()
construct_point = ConstructPoint(XCoordinate=integer_2, YCoordinate=integer_3, ZCoordinate=integer_4)

# ----
# Excelファイルへの書き出し実行
# ①Excelファイルへの書き出しボタン
# ・ボタンを押した時だけTrueになり、書き出しが実行される。
# ・実行時に②で指定するファイルが既に存在する場合は
# 上書きされ、無い場合は新しく作成される。
# 【注意事項】
# 
# ●　②で指定したフォルダが存在しない場合、上手くいかない
# 
# ●　④の※が設定されてない場合、上手くいかない
# ②Excelファイルの作成フォルダとファイル名の指定
# この方法を使う場合、"c:\gh-excel\"はそのままとし、
# ファイル名を自身の「クラス-番号 氏名.xlsx」とする。
# ③Excelファイル内のワークシート名
# ④Excelファイル内での列の見出し
# （データのブランチと対応させる）
# ※Multiline Dataオプションを必ずオフに！
# ⑤Excelファイルへの出力データ
# ・ブランチと同じ数の列がExcel上で作成される。
# ⑥ここを"True"にしておくと、
# Excelファイルへの書き出し時に、
# ②で指定したファイルが既に存在し、且つ
# その中にデータが存在する場合、それらを
# 全てクリアした後にデータを出力する。
panel_12 = Panel("c:\gh-excel\3AA1-01 下川雄一.xlsx")
panel_13 = Panel("""部材名
部材番号
部材長(mm)
断面直径(mm)""")
entwine = Entwine(Branch00=repeat_data, Branch01=flatten_tree_2, Branch02=integer, Branch03=repeat_data_2, FlattenInputs=True)
panel_14 = Panel(entwine)
excel_write = ExcelWrite(
    WriteExcelData=Button(),
    WorkbookPath=panel_12,
    WorksheetName="支柱鋼管リスト",
    ColumnHeadings=panel_13,
    Data=entwine,
    ClearSheet=Toggle(True))
panel_15 = Panel(excel_write)

format = Format(Culture=127)

三角鏡_辺長さ設定値 = Panel("900")
triremesh = TriRemesh(Geometry=surface, Sharp=Toggle(True), Length=三角鏡_辺長さ設定値, Iterations=25)  # -> Triangulation, Dual, Creases
deconstruct_mesh = DeconstructMesh(Mesh=triremesh.Triangulation)  # -> flatten(Vertices), Faces, Colours, Normals
unit_z = UnitZ(Factor=モニュメント厚)
negative_2 = Negative(Value=xy平面_回転角度)

# ----
# 構成点群の空間座標算定ブロック
# xy平面に最低点を合わせるクラスター ↑
formula_for_z = Panel("( u*(x-a)^2 + v*(y-b)^2 )/10^3 + (d*x + e*y)")
rotate = Rotate(Geometry=deconstruct_mesh.Vertices, Angle=degrees(xy平面_回転角度), Plane=PlaneXY(0, 0, 0))  # -> Geometry, Transform
deconstruct_2 = Deconstruct(Point=rotate.Geometry)  # -> XComponent, YComponent, ZComponent
evaluate = Evaluate(
    Expression=formula_for_z,
    x=deconstruct_2.XComponent,
    y=deconstruct_2.YComponent,
    u=x方向_曲率,
    v=y方向_曲率,
    a=x方向_極点,
    b=y方向_極点,
    d=x方向_傾斜,
    e=y方向_傾斜)
panel_16 = Panel(evaluate)
cluster_2 = Cluster_2(relay=evaluate, relay_2=z方向_基準高)

平三角形群の生成コンポーネント = DelaunayMesh(Points=rotate.Geometry, Plane=PlaneXY(0, 0, 0))
construct_point_2 = ConstructPoint(XCoordinate=deconstruct_2.XComponent, YCoordinate=deconstruct_2.YComponent, ZCoordinate=cluster_2)

# ----
# モニュメント成形ブロック
convex_hull = ConvexHull(Points=construct_point_2, Plane=PlaneXY(0, 0, 0))  # -> Hull, HullZ, Indices
move_4 = Move(Geometry=convex_hull.HullZ, Motion=unit_z)  # -> Geometry, Transform

triremesh_2 = TriRemesh(Geometry=convex_hull.HullZ, Sharp=Toggle(True), Length=Slider(730, range=200..2000), Iterations=25)  # -> Triangulation, Dual, Creases
geometry_2 = Geometry(triremesh_2.Triangulation)
face_boundaries = FaceBoundaries(Mesh=triremesh_2.Triangulation)
deconstruct_mesh_2 = DeconstructMesh(Mesh=triremesh_2.Triangulation)  # -> Vertices, Faces, Colours, Normals
triremesh_3 = TriRemesh(Geometry=move_4.Geometry, Sharp=boolean_toggle, Length=number_slider, Iterations=25)  # -> Triangulation, Dual, Creases; disabled

# ----
# (上から順に：
# 　三角形の線群, 小平面群, 側面, 包括曲面 の
# 　　　　　　　　　　　　　　　　　　　生成コンポーネント)
delaunay_edges = DelaunayEdges(Points=construct_point_2, Plane=PlaneXY(0, 0, 0))  # -> Connectivity, flatten(Edges)
patch = Patch(Curves=move_4.Geometry, Spans=20, Flexibility=1, Trim=True)
平三角形群の生成コンポーネント_2 = DelaunayMesh(Points=construct_point_2, Plane=PlaneXY(0, 0, 0))
loft = Loft(
    Curves=[convex_hull.HullZ, move_4.Geometry],
    Options={Adjust=False, Closed=False, LoftEnds=0, LoftSimp=0, LoftType=0, Rebuild=10, Refit=0.01})
geometry_3 = Geometry([loft, patch, 平三角形群の生成コンポーネント_2, delaunay_edges.Edges, triremesh_3.Triangulation])

boundary_surfaces = BoundarySurfaces(Edges=convex_hull.Hull)
disjoint_mesh = DisjointMesh(Mesh=平三角形群の生成コンポーネント_2)  # -> simplify(Meshes)
panel_17 = Panel(disjoint_mesh)

panel_18 = Panel(face_boundaries)
geometry_4 = Geometry(face_boundaries)
surface_2 = Surface(face_boundaries)
data = Data(deconstruct_mesh_2.Vertices)
panel_19 = Panel(deconstruct_mesh_2.Vertices)
list_item = ListItem(List=surface_2, Index=Slider(605, range=0..1000), Wrap=True)

# ----
# 完成！
rotate_2 = Rotate(Geometry=geometry_3, Angle=degrees(negative_2), Plane=PlaneXY(0, 0, 0))  # -> Geometry, Transform
geometry_5 = Geometry(rotate_2.Geometry)

panel_20 = Panel(surface_2)

# ----
# surfaceデータタイプでリスト化を行うブロック
face_boundaries_2 = FaceBoundaries(Mesh=平三角形群の生成コンポーネント)
face_boundaries_3 = FaceBoundaries(Mesh=平三角形群の生成コンポーネント_2)
surface_3 = Surface(flatten(face_boundaries_3))
surface_4 = Surface(flatten(face_boundaries_2))

list_length_2 = ListLength(List=surface_4)

# ----
# 格子生成ブロック
panel_21 = Panel("1.5")
multiplication_3 = Multiplication(A=三角鏡_辺長さ設定値, B=panel_21)
evaluate_2 = Evaluate(Expression="(x/y)^½ +0.499", x=list_length_2, y="2")
integer_5 = Integer(evaluate_2)
multiplication_4 = Multiplication(A=integer_5, B="2")
point = Point(Point(8000, -4000, 0))
rectangular = Rectangular(Plane=point, SizeX=multiplication_3, SizeY=multiplication_3, ExtentX=multiplication_4, ExtentY=integer_5)  # -> Cells, Points

# ----
# 番付ブロック
panel_22 = Panel("0")
series = Series(Start=panel_22, Step="1", Count=list_length_2)
concatenate_2 = Concatenate(FragmentA="Sf.", FragmentB=series)  # -> flatten(Result)
panel_23 = Panel(concatenate_2)

# ----
# 一鏡面データ抽出
panel_24 = Panel("1")
subtraction = Subtraction(A=list_length_2, B=panel_24)
multiplication_5 = Multiplication(A=subtraction, B=Slider(0, range=0..1))
integer_6 = Integer(multiplication_5)
抽出鏡面no = Panel(integer_6)

# ----
# 部材表要素配置
# 鏡面配置
# 文字配置
expression = Expression(u=series, v=multiplication_4, w=multiplication_3, Expression="(u%v+0.05)*w")
expression_2 = Expression(u=series, v=multiplication_4, w=multiplication_3, Expression="(u\v+0.10)*w")
expression_3 = Expression(u=series, v=multiplication_4, w=multiplication_3, Expression="(u%v+0.50)*w")
expression_4 = Expression(u=series, v=multiplication_4, w=multiplication_3, Expression="(u\v+1.05)*w")
vector_xyz = VectorXYZ(XComponent=expression, YComponent=expression_2, ZComponent=0)  # -> flatten(Vector), Length
vector_xyz_2 = VectorXYZ(XComponent=expression_3, YComponent=expression_4, ZComponent=0)  # -> flatten(Vector), Length

# ----
# データ情報整理ブロック
area_2 = Area(Geometry=surface_3)  # -> Area, Centroid
deconstruct_brep = DeconstructBrep(Brep=surface_3)  # -> flatten(Faces), Edges, Vertices
三角形鏡面数 = Panel(list_length_2)
shift_paths = ShiftPaths(Data=deconstruct_brep.Edges, Offset="1")
flip_matrix = FlipMatrix()

# ----
# 並べ替え用指標の設計
deconstruct_3 = Deconstruct(Point=area_2.Centroid)  # -> XComponent, YComponent, ZComponent
bounds = Bounds(Numbers=deconstruct_3.XComponent)
bounds_2 = Bounds(Numbers=deconstruct_3.YComponent)
remap_numbers = RemapNumbers(Value=deconstruct_3.XComponent, Source=bounds, Target=Domain(0, 1))  # -> Mapped, Clipped
remap_numbers_2 = RemapNumbers(Value=deconstruct_3.YComponent, Source=bounds_2, Target=Domain(0, 1))  # -> Mapped, Clipped
expression_5 = Expression(w=integer_5, x=remap_numbers.Mapped, y=remap_numbers_2.Mapped, Expression="(y*w+0.5)\1+x")
panel_25 = Panel(expression_5)

flip_matrix_2 = FlipMatrix(Data=shift_paths)
path_mapper = PathMapper(flip_matrix_2, source="{A}", target="{A;0}")

integer_7 = Integer(deconstruct_3.YComponent)
integer_8 = Integer(deconstruct_3.ZComponent)
integer_9 = Integer(deconstruct_3.XComponent)
entwine_2 = Entwine(Branch0X=integer_9, Branch1X=integer_7, Branch2X=integer_8, FlattenInputs=False)

length_3 = Length(Curve=path_mapper)
construct_path = ConstructPath(Indices=length_3)  # -> flatten(Branch)
entwine_3 = Entwine(
    Branch0X=surface_4,
    Branch1X=surface_3,
    Branch2X=area_2.Area,
    Branch3X=area_2.Centroid,
    Branch4X=entwine_2,
    Branch5X=deconstruct_brep.Faces,
    Branch6X=path_mapper,
    Branch7X=length_3,
    FlattenInputs=False)  # -> simplify(Result)
sort_list = SortList(Keys=expression_5, ValuesValuesA=entwine_3)  # -> Keys, ValuesValuesA
shift_paths_2 = ShiftPaths(Data=sort_list.ValuesValuesA, Offset=-1)
list_item_2 = ListItem(List=shift_paths_2, Index=integer_6, Wrap=True)
panel_26 = Panel(list_item_2)

panel_27 = Panel(deconstruct_brep.Faces)
evaluate_surface = EvaluateSurface(Surface=deconstruct_brep.Faces, Point="{0.5, 0.5, 0}")  # -> Point, Normal, UDirection, VDirection, Frame
panel_28 = Panel(shift_paths_2)
panel_29 = Panel(evaluate_surface.Frame)
tree_branch = TreeBranch(Tree=shift_paths_2, Path=panel_11, MaintainPaths=False)
panel_30 = Panel(flip_matrix)
explode_tree_2 = ExplodeTree(Data=flip_matrix)  # -> flatten(Branch0), flatten(Branch1), flatten(Branch2)

xy_plane_2 = XYPlane(Origin=point)
panel_31 = Panel(""" - 
3 edges Length: """)
move_5 = Move(Geometry=xy_plane_2, Motion=vector_xyz.Vector)  # -> Geometry, Transform
move_6 = Move(Geometry=xy_plane_2, Motion=vector_xyz_2.Vector)  # -> Geometry, Transform
concatenate_3 = Concatenate(FragmentA=concatenate_2, FragmentB=panel_31, FragmentC=relay, FragmentD="Coordinates:", FragmentE=construct_point)  # -> flatten(Result)
orient_2 = Orient(Geometry=deconstruct_brep.Faces, Source=evaluate_surface.Frame, Target=move_5.Geometry)  # -> Geometry, Transform
panel_32 = Panel(concatenate_3)
text_tag_3d_3 = TextTag3D(Location=move_6.Geometry, Text=concatenate_3, Size="50", Justification=5)
geometry_6 = Geometry([rectangular.Cells, orient_2.Geometry])

entwine_4 = Entwine(
    Branch0X=panel_23,
    Branch1X=integer_2,
    Branch2X=integer_3,
    Branch3X=integer_4,
    Branch4X=explode_tree_2.Branch0,
    Branch5X=explode_tree_2.Branch1,
    Branch6X=explode_tree_2.Branch2,
    Branch7X=explode_tree.Branch0,
    FlattenInputs=False)  # -> simplify(Result)
panel_33 = Panel(entwine_4)

# ----
# Excelファイルへの書き出し実行
# アイテムとブランチの整理
# Excelファイルへの書き出しボタン
# ⑤Excelファイルへの出力データ
# ・ブランチと同じ数の列がExcel上で作成される。
# ⑥ここを"True"にしておくと、
# Excelファイルへの書き出し時に、
# ②で指定したファイルが既に存在し、且つ
# その中にデータが存在する場合、それらを
# 全てクリアした後にデータを出力する。
panel_34 = Panel("c:\gh-excel\三宮プラッツ：三辺形鏡面群の数量情報表.xlsx")
panel_35 = Panel("""部材名
部材中心x座標(mm)
部材中心y座標(mm)
部材中心z座標(mm)
辺1長(mm)
辺2長(mm)
辺3長(mm)
部材面積(mm^2)""")
excel_write_2 = ExcelWrite(
    WriteExcelData=Button(),
    WorkbookPath=panel_34,
    WorksheetName="三辺形鏡面リスト",
    ColumnHeadings=panel_35,
    Data=entwine_4,
    ClearSheet=Toggle(True))
panel_36 = Panel(excel_write_2)

# ==== cluster Cluster
length = ClusterInput()
radius = ClusterInput()
division = Division(A=length, B="2")
negative = Negative(Value=division)
construct_domain = ConstructDomain(DomainStart=division, DomainEnd=negative)
rectangle = Rectangle(Plane=PlaneXY(0, 0, 0), XSize=construct_domain, YSize=construct_domain, Radius=radius)  # -> Rectangle, Length
rectangle_2 = ClusterOutput(rectangle.Rectangle)

# ==== cluster Cluster_2
relay = ClusterInput()
bounds = Bounds(Numbers=relay)
deconstruct_domain = DeconstructDomain(Domain=bounds)  # -> Start, End
relay_2 = ClusterInput()
subtraction = Subtraction(A=relay, B=deconstruct_domain.Start)
addition = Addition(A=subtraction, B=relay_2)
result = ClusterOutput(addition)
