# Grasshopper definition 課題4 三宮プラッツ v4.2.gh (Grasshopper 1.0.7)
# plug-ins: Kangaroo2 Components, LunchBox

# ----
# モニュメント生成範囲指定ブロック
# ここに直接平面データの埋め込みも可能 ↑
正方形1辺_長さ = Panel("8400")
四隅丸み = Panel("50")
cluster = Cluster(length=正方形1辺_長さ, radius=四隅丸み)
surface = Surface(cluster)

# ----
# 近似曲面生成式 要素値表
xy平面_回転角度 = Slider(45, range=-180..180)
z方向_基準高 = Panel("0")
y方向_曲率 = Slider(-0.03, range=-0.1..0.1)
x方向_曲率 = Slider(0.05, range=-0.1..0.1)
x方向_極点 = Slider(0, range=-5000..5000)
y方向_極点 = Slider(-500, range=-5000..5000)
x方向_傾斜 = Slider(0.2, range=-1..1)
y方向_傾斜 = Slider(0.3, range=-1..1)
モニュメント厚 = Panel("50")

三角鏡_辺長さ設定値 = Panel("900")

expression = Expression()
panel = Panel("""{0}
{1;0}""")
文字サイズ = Panel("100")
path_mapper = PathMapper(panel, source="{A}", target="{A+6}")
panel_2 = Panel(path_mapper)
merge = Merge(Data1=panel, Data2=panel_2)
panel_3 = Panel(merge)
panel_4 = Panel("""{7}
{3;0}
{3;1}
{3;2}
{4;0}
{4;1}
{4;2}
{1}""")

triremesh = TriRemesh(Geometry=surface, Sharp=Toggle(True), Length=三角鏡_辺長さ設定値, Iterations=25)  # -> Triangulation, Dual, Creases
deconstruct_mesh = DeconstructMesh(Mesh=triremesh.Triangulation)  # -> flatten(Vertices), Faces, Colours, Normals
# フロア毎に組み替えた支柱の基準線
unit_z = UnitZ(Factor=モニュメント厚)
negative = Negative(Value=xy平面_回転角度)

# ----
# 構成点群の空間座標算定ブロック
# xy平面に最低点を合わせるクラスター ↑
formula_for_z = Panel("( u*(x-a)^2 + v*(y-b)^2 )/10^3 + (d*x + e*y)")
rotate = Rotate(Geometry=deconstruct_mesh.Vertices, Angle=degrees(xy平面_回転角度), Plane=PlaneXY(0, 0, 0))  # -> Geometry, Transform
deconstruct = Deconstruct(Point=rotate.Geometry)  # -> XComponent, YComponent, ZComponent
evaluate = Evaluate(
    Expression=formula_for_z,
    x=deconstruct.XComponent,
    y=deconstruct.YComponent,
    u=x方向_曲率,
    v=y方向_曲率,
    a=x方向_極点,
    b=y方向_極点,
    d=x方向_傾斜,
    e=y方向_傾斜)
panel_5 = Panel(evaluate)
cluster_2 = Cluster_2(relay=evaluate, relay_2=z方向_基準高)

平三角形群の生成コンポーネント = DelaunayMesh(Points=rotate.Geometry, Plane=PlaneXY(0, 0, 0))
construct_point = ConstructPoint(XCoordinate=deconstruct.XComponent, YCoordinate=deconstruct.YComponent, ZCoordinate=cluster_2)

# ----
# モニュメント成形ブロック
convex_hull = ConvexHull(Points=construct_point, Plane=PlaneXY(0, 0, 0))  # -> Hull, HullZ, Indices
move = Move(Geometry=convex_hull.HullZ, Motion=unit_z)  # -> Geometry, Transform

boolean_toggle = BooleanToggle(True)  # disabled
number_slider = Slider(730, range=200..2000)  # disabled
triremesh_2 = TriRemesh(Geometry=move.Geometry, Sharp=boolean_toggle, Length=number_slider, Iterations=25)  # -> Triangulation, Dual, Creases; disabled

boundary_surfaces = BoundarySurfaces(Edges=convex_hull.Hull)

# ----
# (上から順に：
# 　三角形の線群, 小平面群, 側面, 包括曲面 の
# 　　　　　　　　　　　　　　　　　　　生成コンポーネント)
delaunay_edges = DelaunayEdges(Points=construct_point, Plane=PlaneXY(0, 0, 0))  # -> Connectivity, flatten(Edges)
patch = Patch(Curves=move.Geometry, Spans=20, Flexibility=1, Trim=True)
平三角形群の生成コンポーネント_2 = DelaunayMesh(Points=construct_point, Plane=PlaneXY(0, 0, 0))
loft = Loft(
    Curves=[convex_hull.HullZ, move.Geometry],
    Options={Adjust=False, Closed=False, LoftEnds=0, LoftSimp=0, LoftType=0, Rebuild=10, Refit=0.01})
geometry = Geometry([loft, patch, 平三角形群の生成コンポーネント_2, delaunay_edges.Edges, triremesh_2.Triangulation])

# ----
# 完成！
rotate_2 = Rotate(Geometry=geometry, Angle=degrees(negative), Plane=PlaneXY(0, 0, 0))  # -> Geometry, Transform
disjoint_mesh = DisjointMesh(Mesh=平三角形群の生成コンポーネント_2)  # -> simplify(Meshes)
panel_6 = Panel(disjoint_mesh)
geometry_2 = Geometry(rotate_2.Geometry)

# ----
# surfaceデータタイプでリスト化を行うブロック
entwine = Entwine(Branch00=平三角形群の生成コンポーネント, Branch01=平三角形群の生成コンポーネント_2, FlattenInputs=True)
negative_2 = Negative(Value=xy平面_回転角度)
rotate_3 = Rotate(Geometry=entwine, Angle=degrees(negative_2), Plane=PlaneXY(0, 0, 0))  # -> Geometry, Transform
face_boundaries = FaceBoundaries(Mesh=rotate_3.Geometry)
surface_2 = Surface(face_boundaries)
path_mapper_2 = PathMapper(surface_2, source="{0;A;0}", target="{A;0}")
tree_branch = TreeBranch(Tree=surface_2, Path="{0;1;0}", MaintainPaths=False)

panel_7 = Panel(tree_branch)
list_length = ListLength(List=tree_branch)

# ----
# 情報抽出ブロック
# 各三角形鏡面の
# 　・構成辺とその長さ
# 　・基準平面情報
deconstruct_brep = DeconstructBrep(Brep=tree_branch)  # -> flatten(Faces), Edges, Vertices
shift_paths = ShiftPaths(Data=deconstruct_brep.Edges, Offset="1")
evaluate_surface = EvaluateSurface(Surface=deconstruct_brep.Faces, Point="{0.5, 0.5, 0}")  # -> Point, Normal, UDirection, VDirection, Frame
flip_matrix = FlipMatrix(Data=shift_paths)
path_mapper_3 = PathMapper(flip_matrix, source="{A}", target="{A;0}")
length = Length(Curve=path_mapper_3)
integer = Integer(length)

# ----
# データ情報整理ブロック
area = Area(Geometry=tree_branch)  # -> Area, Centroid
三角形鏡面数 = Panel(list_length)
panel_8 = Panel(integer)

# ----
# 格子生成ブロック
panel_9 = Panel("1.5")
multiplication = Multiplication(A=三角鏡_辺長さ設定値, B=panel_9)
evaluate_2 = Evaluate(Expression="(x/y)^½ +0.499", x=list_length, y="2")
integer_2 = Integer(evaluate_2)
multiplication_2 = Multiplication(A=integer_2, B="2")
point = Point(Point(8000, -4000, 0))
rectangular = Rectangular(Plane=point, SizeX=multiplication, SizeY=multiplication, ExtentX=multiplication_2, ExtentY=integer_2)  # -> Cells, Points

# ----
# 座標値整数化･並べ替え指標値の設計
deconstruct_2 = Deconstruct(Point=area.Centroid)  # -> XComponent, YComponent, ZComponent
bounds = Bounds(Numbers=deconstruct_2.XComponent)
bounds_2 = Bounds(Numbers=deconstruct_2.YComponent)
entwine_2 = Entwine(
    Branch0X=deconstruct_2.XComponent,
    Branch1X=deconstruct_2.YComponent,
    Branch2X=deconstruct_2.ZComponent,
    FlattenInputs=False)
remap_numbers = RemapNumbers(Value=deconstruct_2.XComponent, Source=bounds, Target=Domain(0, 1))  # -> Mapped, Clipped
remap_numbers_2 = RemapNumbers(Value=deconstruct_2.YComponent, Source=bounds_2, Target=Domain(0, 1))  # -> Mapped, Clipped
integer_3 = Integer(entwine_2)
expression_2 = Expression(w=integer_2, x=remap_numbers.Mapped, y=remap_numbers_2.Mapped, Expression="(y*w+0.5)\1+x")

# ----
# 番付ブロック
panel_10 = Panel("0")
series = Series(Start=panel_10, Step="1", Count=list_length)
concatenate = Concatenate(FragmentA="Sf.", FragmentB=series)  # -> flatten(Result)
panel_11 = Panel(concatenate)

# ----
# 並び替え実行⇒データ再分散
entwine_3 = Entwine(
    Branch0X=path_mapper_2,
    Branch1X=area.Area,
    Branch2X=area.Centroid,
    Branch3X=integer_3,
    Branch4X=integer,
    Branch5X=path_mapper_3,
    Branch6X=evaluate_surface.Frame,
    FlattenInputs=False)  # -> simplify(Result)
sort_list = SortList(Keys=expression_2, ValuesValuesA=entwine_3)  # -> Keys, ValuesValuesA
shift_paths_2 = ShiftPaths(Data=sort_list.ValuesValuesA, Offset=-1)
explode_tree = ExplodeTree(Data=shift_paths_2)  # -> Branch0, Branch1, Branch2, Branch3, Branch4, Branch5, Branch6, Branch7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

# ----
# 部材表要素配置
# 鏡面配置
# 文字配置
expression_3 = Expression(u=series, v=multiplication_2, w=multiplication, Expression="(u%v+0.05)*w")
expression_4 = Expression(u=series, v=multiplication_2, w=multiplication, Expression="(u\v+0.10)*w")
expression_5 = Expression(u=series, v=multiplication_2, w=multiplication, Expression="(u%v+0.50)*w")
expression_6 = Expression(u=series, v=multiplication_2, w=multiplication, Expression="(u\v+1.00)*w")
vector_xyz = VectorXYZ(XComponent=expression_3, YComponent=expression_4, ZComponent=0)  # -> flatten(Vector), Length
vector_xyz_2 = VectorXYZ(XComponent=expression_5, YComponent=expression_6, ZComponent=0)  # -> flatten(Vector), Length

panel_12 = Panel(shift_paths_2)

xy_plane = XYPlane(Origin=point)
move_2 = Move(Geometry=xy_plane, Motion=vector_xyz.Vector)  # -> Geometry, Transform
move_3 = Move(Geometry=xy_plane, Motion=vector_xyz_2.Vector)  # -> Geometry, Transform
orient = Orient(Geometry=explode_tree.Branch1, Source=explode_tree.Branch13, Target=move_2.Geometry)  # -> Geometry, Transform
geometry_3 = Geometry(orient.Geometry)

unit_z_2 = UnitZ(Factor=1)
番号引出距離 = Panel("2000")
line_sdl = LineSDL(Start=explode_tree.Branch3, Direction=unit_z_2, Length=番号引出距離)  # -> flatten(Line)
marker_dimension = MarkerDimension(Line=line_sdl, Text=concatenate, Size=文字サイズ)

panel_13 = Panel("""{0} : 
Coordinates = x:{1}, y:{2}, z:{3} 
3edges Length = {4}, {5}, {6}  [mm]""")
format = Format(
    Format=panel_13,
    Culture=127,
    Data0=concatenate,
    Data1=explode_tree.Branch4,
    Data2=explode_tree.Branch5,
    Data3=explode_tree.Branch6,
    Data4=explode_tree.Branch7,
    Data5=explode_tree.Branch8,
    Data6=explode_tree.Branch9)  # -> flatten(Text)
panel_14 = Panel(format)
text_tag_3d = TextTag3D(Location=move_3.Geometry, Text=format, Size="50", Justification=5)

# ----
# 一鏡面データ抽出
number_slider_2 = Slider(0.459326, range=0..1)
expression_7 = Expression(c=list_length, f=number_slider_2, Expression="(c-1)*f\1")
抽出鏡面no = Panel(expression_7)

entwine_4 = Entwine(Branch0X=concatenate, Branch1X=geometry_3, Branch2X=line_sdl, FlattenInputs=False)  # -> simplify(Result)

# ----
# 支柱の中心線の長さから寸法線を作成
# 一覧表内：部材長寸法
deconstruct_brep_2 = DeconstructBrep(Brep=geometry_3)  # -> Faces, Edges, Vertices
文字サイズ_2 = Slider(40, range=0..1000)
xy_plane_2 = XYPlane(Origin=Point(0, 0, 0))
end_points = EndPoints(Curve=deconstruct_brep_2.Edges)  # -> Start, End
aligned_dimension = AlignedDimension(
    Plane=xy_plane_2,
    PointA=end_points.Start,
    PointB=end_points.End,
    Offset=Slider(-75, range=-1000..1000),
    Text="{0:0}",
    Size=文字サイズ_2)

path_mapper_4 = PathMapper(entwine_4, source=["{A}", "{A;*}"], target=["{A+7}", "{A+7}"])
panel_15 = Panel(path_mapper_4)
merge_2 = Merge(Data1=shift_paths_2, Data2=path_mapper_4)

list_item = ListItem(List=merge_2, Index=expression_7, Wrap=True)
panel_16 = Panel("""{0}
{1;0}""")
panel_17 = Panel("""{4;0}
{4;1}
{4;2}
{2}""")
tree_branch_2 = TreeBranch(Tree=merge_2, Path=panel_17, MaintainPaths=False)
tree_branch_3 = TreeBranch(Tree=list_item, Path=panel_16, MaintainPaths=False)
panel_18 = Panel(list_item)
geometry_4 = Geometry(tree_branch_2)
geometry_5 = Geometry(tree_branch_3)

tree_branch_4 = TreeBranch(Tree=merge_2, Path=panel_4, MaintainPaths=False)
geometry_6 = Geometry(list_item)

# ----
# Excelファイルへの書き出し実行
# アイテムとブランチの整理
# Excelファイルへの書き出しボタン
# ⑤Excelファイルへの出力データ
# ・ブランチと同じ数の列がExcel上で作成される。
# ⑥ここを"True"にしておくと、
# Excelファイルへの書き出し時に、
# ②で指定したファイルが既に存在し、且つ
# その中にデータが存在する場合、それらを
# 全てクリアした後にデータを出力する。
panel_19 = Panel("c:\gh-excel\三宮プラッツ：三辺形鏡面群の数量情報表.xlsx")
panel_20 = Panel("""部材名
部材中心x座標(mm)
部材中心y座標(mm)
部材中心z座標(mm)
辺1長(mm)
辺2長(mm)
辺3長(mm)
部材面積(mm^2)""")
excel_write = ExcelWrite(
    WriteExcelData=Button(),
    WorkbookPath=panel_19,
    WorksheetName="三辺形鏡面リスト",
    ColumnHeadings=panel_20,
    Data=tree_branch_4,
    ClearSheet=Toggle(True))

panel_21 = Panel(merge_2)

# ==== cluster Cluster
length = ClusterInput()
radius = ClusterInput()
division = Division(A=length, B="2")
negative = Negative(Value=division)
construct_domain = ConstructDomain(DomainStart=division, DomainEnd=negative)
rectangle = Rectangle(Plane=PlaneXY(0, 0, 0), XSize=construct_domain, YSize=construct_domain, Radius=radius)  # -> Rectangle, Length
rectangle_2 = ClusterOutput(rectangle.Rectangle)

# ==== cluster Cluster_2
relay = ClusterInput()
bounds = Bounds(Numbers=relay)
deconstruct_domain = DeconstructDomain(Domain=bounds)  # -> Start, End
relay_2 = ClusterInput()
subtraction = Subtraction(A=relay, B=deconstruct_domain.Start)
addition = Addition(A=subtraction, B=relay_2)
result = ClusterOutput(addition)
