# Grasshopper definition 課題4 三宮プラッツ v5.00.gh (Grasshopper 1.0.7)
# plug-ins: Kangaroo2 Components, LunchBox

# ----
# パラメータエリア
# 課題3 完成3Dモデル確認
# 課題4 部材表確認
# 課題4+ 単体鏡面指定抽出
# 形状要素値の初期設定
# モニュメント生成範囲指定ブロック
# ここに直接平面データの埋め込みも可能 ↑
正方形1辺_長さ = Panel("8400")
四隅丸み = Panel("50")
# 課題4 Excelデータ出力確認
cluster = Cluster(length=正方形1辺_長さ, radius=四隅丸み)
surface = Surface(cluster)

三角鏡_辺長さ設定値 = Panel("800")

# ----
# 近似曲面生成式 要素値表
xy平面_回転角度 = Slider(45, range=-180..180)
z方向_基準高 = Panel("0")
y方向_曲率 = Slider(-0.03, range=-0.1..0.1)
x方向_曲率 = Slider(0.05, range=-0.1..0.1)
x方向_極点 = Slider(0, range=-5000..5000)
y方向_極点 = Slider(-500, range=-5000..5000)
x方向_傾斜 = Slider(0.2, range=-1..1)
y方向_傾斜 = Slider(0.3, range=-1..1)
モニュメント厚 = Panel("50")

# ----
# 操作用パラメータ
# 形状要素値の初期設定
expression = Expression()

# ----
# 課題3・再編
triremesh = TriRemesh(Geometry=surface, Sharp=Toggle(True), Length=三角鏡_辺長さ設定値, Iterations=25)  # -> Triangulation, Dual, Creases
deconstruct_mesh = DeconstructMesh(Mesh=triremesh.Triangulation)  # -> flatten(Vertices), Faces, Colours, Normals
# フロア毎に組み替えた支柱の基準線
unit_z = UnitZ(Factor=モニュメント厚)
negative = Negative(Value=xy平面_回転角度)

# ----
# 構成点群の空間座標算定ブロック
# xy平面に最低点を合わせるクラスター ↑
各店z座標値_計算式 = Panel("( u*(x-a)^2 + v*(y-b)^2 )/10^3 + (d*x + e*y)")
rotate = Rotate(Geometry=deconstruct_mesh.Vertices, Angle=degrees(xy平面_回転角度), Plane=PlaneXY(0, 0, 0))  # -> Geometry, Transform
deconstruct = Deconstruct(Point=rotate.Geometry)  # -> XComponent, YComponent, ZComponent
evaluate = Evaluate(
    Expression=各店z座標値_計算式,
    x=deconstruct.XComponent,
    y=deconstruct.YComponent,
    u=x方向_曲率,
    v=y方向_曲率,
    a=x方向_極点,
    b=y方向_極点,
    d=x方向_傾斜,
    e=y方向_傾斜)
panel = Panel(evaluate)
cluster_2 = Cluster_2(relay=evaluate, relay_2=z方向_基準高)

平三角形群の生成コンポーネント = DelaunayMesh(Points=rotate.Geometry, Plane=PlaneXY(0, 0, 0))
construct_point = ConstructPoint(XCoordinate=deconstruct.XComponent, YCoordinate=deconstruct.YComponent, ZCoordinate=cluster_2)

# ----
# モニュメント成形ブロック
convex_hull = ConvexHull(Points=construct_point, Plane=PlaneXY(0, 0, 0))  # -> Hull, HullZ, Indices
move = Move(Geometry=convex_hull.HullZ, Motion=unit_z)  # -> Geometry, Transform

# ----
# （骨格試作）
boolean_toggle = BooleanToggle(True)  # disabled
number_slider = Slider(730, range=200..2000)  # disabled
triremesh_2 = TriRemesh(Geometry=move.Geometry, Sharp=boolean_toggle, Length=number_slider, Iterations=25)  # -> Triangulation, Dual, Creases; disabled

boundary_surfaces = BoundarySurfaces(Edges=convex_hull.Hull)

# ----
# (上から順に：
# 　三角形の線群, 小平面群, 側面, 包括曲面 の
# 　　　　　　　　　　　　　　　　　　　生成コンポーネント)
delaunay_edges = DelaunayEdges(Points=construct_point, Plane=PlaneXY(0, 0, 0))  # -> Connectivity, flatten(Edges)
patch = Patch(Curves=move.Geometry, Spans=20, Flexibility=1, Trim=True)
平三角形群の生成コンポーネント_2 = DelaunayMesh(Points=construct_point, Plane=PlaneXY(0, 0, 0))
loft = Loft(
    Curves=[convex_hull.HullZ, move.Geometry],
    Options={Adjust=False, Closed=False, LoftEnds=0, LoftSimp=0, LoftType=0, Rebuild=10, Refit=0.01})
geometry = Geometry([loft, patch, 平三角形群の生成コンポーネント_2, delaunay_edges.Edges, triremesh_2.Triangulation])

# ----
# 課題3: 3Dモデル化 完成！
rotate_2 = Rotate(Geometry=geometry, Angle=degrees(negative), Plane=PlaneXY(0, 0, 0))  # -> Geometry, Transform
disjoint_mesh = DisjointMesh(Mesh=平三角形群の生成コンポーネント_2)  # -> simplify(Meshes)
panel_2 = Panel(disjoint_mesh)
geometry_2 = Geometry(rotate_2.Geometry)

# ----
# surfaceデータタイプでリスト化を行うブロック
entwine = Entwine(Branch00=平三角形群の生成コンポーネント, Branch01=平三角形群の生成コンポーネント_2, FlattenInputs=True)
negative_2 = Negative(Value=xy平面_回転角度)
rotate_3 = Rotate(Geometry=entwine, Angle=degrees(negative_2), Plane=PlaneXY(0, 0, 0))  # -> Geometry, Transform
face_boundaries = FaceBoundaries(Mesh=rotate_3.Geometry)
surface_2 = Surface(face_boundaries)
path_mapper = PathMapper(surface_2, source="{0;A;0}", target="{A;0}")
tree_branch = TreeBranch(Tree=surface_2, Path="{0;1;0}", MaintainPaths=False)
list_length = ListLength(List=tree_branch)
area = Area(Geometry=tree_branch)  # -> Area, Centroid

# ----
# 情報抽出ブロック
# 各三角形鏡面の
# 　・構成辺とその長さ
# 　・基準平面情報
deconstruct_brep = DeconstructBrep(Brep=tree_branch)  # -> flatten(Faces), Edges, Vertices
shift_paths = ShiftPaths(Data=deconstruct_brep.Edges, Offset="1")
flip_matrix = FlipMatrix(Data=shift_paths)
evaluate_surface = EvaluateSurface(Surface=deconstruct_brep.Faces, Point="{0.5, 0.5, 0}")  # -> Point, Normal, UDirection, VDirection, Frame
path_mapper_2 = PathMapper(flip_matrix, source="{A}", target="{A;0}")
length = Length(Curve=path_mapper_2)
integer = Integer(length)

# ----
# 格子生成ブロック
区画サイズ倍率 = Slider(1.5, range=1..2)
横長率 = Slider(2, range=0.5..3)
multiplication = Multiplication(A=三角鏡_辺長さ設定値, B=区画サイズ倍率)
evaluate_2 = Evaluate(Expression="(x/y)^½ +0.499", x=list_length, y=横長率)
integer_2 = Integer(evaluate_2)
multiplication_2 = Multiplication(A=integer_2, B=横長率)
point = Point(Point(8000, -4000, 0))
rectangular = Rectangular(Plane=point, SizeX=multiplication, SizeY=multiplication, ExtentX=multiplication_2, ExtentY=integer_2)  # -> Cells, Points

# ----
# 座標値整数化･並べ替え指標値の設計
deconstruct_2 = Deconstruct(Point=area.Centroid)  # -> XComponent, YComponent, ZComponent
bounds = Bounds(Numbers=deconstruct_2.XComponent)
bounds_2 = Bounds(Numbers=deconstruct_2.YComponent)
entwine_2 = Entwine(
    Branch0X=deconstruct_2.XComponent,
    Branch1X=deconstruct_2.YComponent,
    Branch2X=deconstruct_2.ZComponent,
    FlattenInputs=False)
remap_numbers = RemapNumbers(Value=deconstruct_2.XComponent, Source=bounds, Target=Domain(0, 1))  # -> Mapped, Clipped
remap_numbers_2 = RemapNumbers(Value=deconstruct_2.YComponent, Source=bounds_2, Target=Domain(0, 1))  # -> Mapped, Clipped
integer_3 = Integer(entwine_2)
expression_2 = Expression(w=integer_2, x=remap_numbers.Mapped, y=remap_numbers_2.Mapped, Expression="(y*w+0.5)\1+x")

# ----
# 番付ブロック
panel_3 = Panel("0")
series = Series(Start=panel_3, Step="1", Count=list_length)
concatenate = Concatenate(FragmentA="Sf.", FragmentB=series)  # -> flatten(Result)
panel_4 = Panel(concatenate)

# ----
# 各要素配置座標
# 鏡面配置
# 文字配置
expression_3 = Expression(u=series, v=multiplication_2, w=multiplication, Expression="(u%v+0.05)*w")
expression_4 = Expression(u=series, v=multiplication_2, w=multiplication, Expression="(u\v+0.10)*w")
expression_5 = Expression(u=series, v=multiplication_2, w=multiplication, Expression="(u%v+0.50)*w")
expression_6 = Expression(u=series, v=multiplication_2, w=multiplication, Expression="(u\v+1.05)*w")
vector_xyz = VectorXYZ(XComponent=expression_3, YComponent=expression_4, ZComponent=0)  # -> flatten(Vector), Length
vector_xyz_2 = VectorXYZ(XComponent=expression_5, YComponent=expression_6, ZComponent=0)  # -> flatten(Vector), Length

# ----
# 部材表作成-2
# 部材表格子
geometry_3 = Geometry(rectangular.Cells)

# ----
# 単体鏡面指定抽出
number_slider_2 = Slider(0, range=0..1)
expression_7 = Expression(c=list_length, f=number_slider_2, Expression="(c-1)*f\1")
抽出鏡面no = Panel(expression_7)

# ----
# 課題4 （データ化対象：トラス鏡面のみ）
# 抽出データ指定
panel_5 = Panel(tree_branch)
expression_8 = Expression(g=area.Area, Expression="g\1000")
# 部材表作成-1
三角形鏡面数 = Panel(list_length)
panel_6 = Panel(integer)

# ----
# 並び替え実行⇒データ再分散
entwine_3 = Entwine(
    Branch0X=path_mapper,
    Branch1X=expression_8,
    Branch2X=area.Centroid,
    Branch3X=integer_3,
    Branch4X=integer,
    Branch5X=path_mapper_2,
    Branch6X=evaluate_surface.Frame,
    FlattenInputs=False)  # -> simplify(Result)
sort_list = SortList(Keys=expression_2, ValuesValuesA=entwine_3)  # -> Keys, ValuesValuesA
shift_paths_2 = ShiftPaths(Data=sort_list.ValuesValuesA, Offset=-1)
explode_tree = ExplodeTree(Data=shift_paths_2)  # -> Branch0, Branch1, Branch2, Branch3, Branch4, Branch5, Branch6, Branch7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

鏡面番号表示位置 = Slider(2000, range=0..10000)
unit_z_2 = UnitZ(Factor=1)
line_sdl = LineSDL(Start=explode_tree.Branch3, Direction=unit_z_2, Length=鏡面番号表示位置)  # -> flatten(Line)
文字サイズ = Slider(100, range=0..1000)
marker_dimension = MarkerDimension(Line=line_sdl, Text=concatenate, Size=文字サイズ)

# ----
# 部材表へ鏡面配置
xy_plane = XYPlane(Origin=point)
move_2 = Move(Geometry=xy_plane, Motion=vector_xyz.Vector)  # -> Geometry, Transform
move_3 = Move(Geometry=xy_plane, Motion=vector_xyz_2.Vector)  # -> Geometry, Transform
orient = Orient(Geometry=explode_tree.Branch1, Source=explode_tree.Branch13, Target=move_2.Geometry)  # -> Geometry, Transform
geometry_4 = Geometry(orient.Geometry)

# ----
# 文字列生成&表示
# 　＜部材番号, 中心座標, ３辺各長さ, 面積＞
panel_7 = Panel("""{0} : 
Coordinates = x:{1}, y:{2}, z:{3} 
3edges Length = {4}, {5}, {6}  [mm]
Area = {7}/1000 [m2]""")
format = Format(
    Format=panel_7,
    Culture=127,
    Data0=concatenate,
    Data1=explode_tree.Branch4,
    Data2=explode_tree.Branch5,
    Data3=explode_tree.Branch6,
    Data4=explode_tree.Branch7,
    Data5=explode_tree.Branch8,
    Data6=explode_tree.Branch9,
    Data7=explode_tree.Branch2)  # -> flatten(Text)
text_tag_3d = TextTag3D(Location=move_3.Geometry, Text=format, Size="50", Justification=5)

# ----
# 三角形鏡面の各辺寸法線を作成
deconstruct_brep_2 = DeconstructBrep(Brep=geometry_4)  # -> Faces, Edges, Vertices
引出間隔 = Slider(-75, range=-1000..1000)
文字サイズ_2 = Slider(40, range=0..1000)
xy_plane_2 = XYPlane(Origin=Point(0, 0, 0))
end_points = EndPoints(Curve=deconstruct_brep_2.Edges)  # -> Start, End
書式形式 = Panel("{0:0}")
aligned_dimension = AlignedDimension(Plane=xy_plane_2, PointA=end_points.Start, PointB=end_points.End, Offset=引出間隔, Text=書式形式, Size=文字サイズ_2)

# ----
# データ最終統合
entwine_4 = Entwine(Branch0X=concatenate, Branch1X=geometry_4, FlattenInputs=False)  # -> simplify(Result)
path_mapper_3 = PathMapper(entwine_4, source=["{A}", "{A;*}"], target=["{A+7}", "{A+7}"])
merge = Merge(Data1=shift_paths_2, Data2=path_mapper_3)

panel_8 = Panel(shift_paths_2)
panel_9 = Panel(format)
list_item = ListItem(List=merge, Index=expression_7, Wrap=True)

panel_10 = Panel(path_mapper_3)

# ----
# Excelデータ出力確認
# Excelファイルへの書き出しボタン
panel_11 = Panel("c:\gh-excel\三宮プラッツ：三角トラス鏡面群の数量情報表.xlsx")
panel_12 = Panel("""部材名
部材中心x座標(mm)
部材中心y座標(mm)
部材中心z座標(mm)
辺1長(mm)
辺2長(mm)
辺3長(mm)
部材面積(10^-3 m^2)""")
panel_13 = Panel("""{7}
{3;0}
{3;1}
{3;2}
{4;0}
{4;1}
{4;2}
{1}""")
tree_branch_2 = TreeBranch(Tree=merge, Path=panel_13, MaintainPaths=False)
excel_write = ExcelWrite(
    WriteExcelData=Button(),
    WorkbookPath=panel_11,
    WorksheetName="三角形鏡面データリスト",
    ColumnHeadings=panel_12,
    Data=tree_branch_2,
    ClearSheet=Toggle(True))

# ----
# 指定出力： 図 ↓
panel_14 = Panel("""{0;0}
{0;1}
{2}
{5;0}
{5;1}
{5;2}
{8}""")
tree_branch_3 = TreeBranch(Tree=list_item, Path=panel_14, MaintainPaths=True)
panel_15 = Panel(tree_branch_3)
geometry_5 = Geometry(tree_branch_3)

# ----
# 指定出力： 引出線 ↓
unit_z_3 = UnitZ(Factor=1)
鏡面番号表示位置_2 = Slider(4000, range=0..10000)
tree_branch_4 = TreeBranch(Tree=list_item, Path="{7}", MaintainPaths=False)
tree_branch_5 = TreeBranch(Tree=list_item, Path="{2}", MaintainPaths=False)
line_sdl_2 = LineSDL(Start=tree_branch_5, Direction=unit_z_3, Length=鏡面番号表示位置_2)  # -> flatten(Line)
文字サイズ_3 = Slider(300, range=0..1000)
marker_dimension_2 = MarkerDimension(Line=line_sdl_2, Text=tree_branch_4, Size=文字サイズ_3)

panel_16 = Panel(list_item)

# ==== cluster Cluster
length = ClusterInput()
radius = ClusterInput()
division = Division(A=length, B="2")
negative = Negative(Value=division)
construct_domain = ConstructDomain(DomainStart=division, DomainEnd=negative)
rectangle = Rectangle(Plane=PlaneXY(0, 0, 0), XSize=construct_domain, YSize=construct_domain, Radius=radius)  # -> Rectangle, Length
rectangle_2 = ClusterOutput(rectangle.Rectangle)

# ==== cluster Cluster_2
relay = ClusterInput()
bounds = Bounds(Numbers=relay)
deconstruct_domain = DeconstructDomain(Domain=bounds)  # -> Start, End
relay_2 = ClusterInput()
subtraction = Subtraction(A=relay, B=deconstruct_domain.Start)
addition = Addition(A=subtraction, B=relay_2)
result = ClusterOutput(addition)
